# Grasshopper definition 20160320_1beam_master_nonuniformprop.gh (Grasshopper 0.9.76)
# plug-ins: Python Interpreter, TMarsupilami, BRelaxGH

N = Slider(20, range=0..100)

list = ValueList({"symetric": 1, "antisymetric": -1}, selected="antisymetric")
twist = Slider(28, range=-45..45)
a = Slider(10, range=5..20)
ouverture = Slider(30, range=0..90)

b1 = Slider(0.15, range=0.01..0.5)
b2 = Slider(0.45, range=0..0.5)

elongation = Slider(1, range=0.5..1.5)
theta_0 = Slider(0, range=-20..20)

twistmodulo = Slider(0, range=-2..2)
vdisex = VectorDisplayEx(Colour=RGB(0, 0, 0), Width=2)
vdis = VectorDisplay()
division = Division(A=N, B=3)
beam_setup = BeamSetup(
    N=N,
    section_b1=b1,
    section_b2=b2,
    initial_a=a,
    initial_ouverture=ouverture,
    initial_twist=twist,
    initial_twistmodulo=twistmodulo,
    intial_symetric=list,
    repos_epsilon=elongation,
    repos_theta=theta_0)  # -> section_xy, planes_0_2, planes_i_2
int = Integer(division)

N_2 = Slider(12, range=0..100)
section_b1 = Number(b1)
section_b2 = Number(b2)
subtraction = Subtraction(A=N, B=int)
repeat = RepeatData(Data=section_b1, Length=int)
repeat_2 = RepeatData(Data=section_b1, Length=subtraction)
repeat_3 = RepeatData(Data=section_b2, Length=int)
repeat_4 = RepeatData(Data=section_b2, Length=subtraction)
division_2 = Division(A=repeat_2, B=1)
division_3 = Division(A=repeat_4, B=1.25)

cluster = Cluster_2(pln=beam_setup.planes_i_2)

# ---- group: Calcul avec Brelax / gRIDshell
lanch = Button()
path_to_input_file = FilePath("C:\Users\Lionel\Desktop\gRiDshell\simplebeam.txt")
path_to_gridshell_exe = FilePath("C:\Users\Lionel\Desktop\gRiDshell\gRiDshell.exe")
panel = Panel([path_to_gridshell_exe, path_to_input_file])
launcher = Launcher(GRIDshellExePath=path_to_gridshell_exe, InputFilePath=path_to_input_file, Launch=lanch)  # -> Results, OutputFilePath

# ----
section_b1_2 = Number([repeat, division_2])
section_b2_2 = Number([repeat_3, division_3])
dom = ConstructDomain(DomainStart=expr("-x/2", section_b2_2), DomainEnd=expr("x/2", section_b2_2))
dom_2 = ConstructDomain(DomainStart=expr("-x/2", section_b1_2), DomainEnd=expr("x/2", section_b1_2))
rectangle = Rectangle(Plane=PlaneXY(0, 0, 0), XSize=dom_2, YSize=dom, Radius=0)  # -> Section_XY, Length

# ---- group: Beam A
section_xy = Curve(rectangle.Section_XY)
sections_0 = Plane(beam_setup.planes_0_2)
sections_i = Plane(cluster)
section_b1_3 = Number([repeat, division_2])
section_b2_3 = Number([repeat_3, division_3])

# ----
item = ListItem(List=sections_i, Index=-1, Wrap=True)
item_2 = ListItem(List=sections_i, Index=0, Wrap=True)
geom = DefineBeamGeometrySingle(StartFrame=item_2, EndFrame=item, EdgeCount=10, RateOfTwist=0)

colors = Colour([RGB(0, 0, 255), RGB(255, 255, 255)])
section_xy_2 = Curve(section_xy)
sections_0_2 = Plane(sections_0)
sections_i_2 = Plane(sections_i)
beam_preview = BeamPreview(colors=colors, section=section_xy_2, mframe=sections_0_2)
beam_preview_2 = BeamPreview(colors=colors, section=section_xy_2, mframe=sections_i_2)
frames = Frames(L=sections_i_2, scale=1, W=1)
end_frames = EndFrames(L=sections_i_2, scale=2, W=3)

python = PythonScript(section=section_xy, mframe=sections_i)  # -> out, brep; inputs section: list of Curve, mframe: list of Plane
# ---------- python: Python ----------
import rhinoscriptsyntax as rs
import Rhino as rh

n = len(mframe)
pts = []

# create centerline
for i in range(n):
    pts.append(mframe[i].Origin)
centerline = rh.Geometry.Curve.CreateControlPointCurve(pts)

# split centerline
t = []
for pt in pts:
    t.append(rs.CurveClosestPoint(centerline, pt))
rails = centerline.Split(t)

brep = []
for i in range(n-1):
    xform = rh.Geometry.Transform.PlaneToPlane(rh.Geometry.Plane.WorldXY, mframe[i])
    shape = section[i]
    shape.Transform(xform)
    rail = rails[i]
    
    brep.append(rh.Geometry.Brep.CreateFromSweep(rail, shape, True, 1e-5)[0])



print t
# ---------- end python ----------

# ---- group: Display BRelax Results
grossissement = Slider(1, range=0..10)
lecture_output = PythonScript(output=launcher.Results)  # -> out, E, G, a, b, x, x_bar, theta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
# ---------- lecture_output: Python ----------
s = output.split()
x = []
x_bar = []
theta = []
theta_bar = []
u_0 = []
u_0_bar = []
i = 0
j = 0
while(i<len(s)) :
    if s[i] == "MATE" :
        E = float(s[i+2])
        G = float(s[i+3])
        i+=4
    elif s[i] == "PROF" :
        a = float(s[i+3])
        b = float(s[i+4])
        i+=5
    elif s[i] == "BEAM" :
        x.append([])
        theta.append([])
        x_bar.append([])
        theta_bar.append([])
        u_0.append((float(s[i+4]),float(s[i+5]),float(s[i+6])))
        u_0_bar.append((float(s[i+7]),float(s[i+8]),float(s[i+9])))
        i+=10
        while s[i] == "NODE" :
            x[j].append((float(s[i+1]),float(s[i+2]),float(s[i+3])))
            theta[j].append(float(s[i+4]))
            x_bar[j].append((float(s[i+5]),float(s[i+6]),float(s[i+7])))
            theta_bar[j].append(float(s[i+8]))
            i+=10
        j+=1
    elif s[i] == "CONV" :
        nbIter = int(s[i+1])
        i+=1
    else :
        i+=1
# ---------- end lecture_output ----------
rendu = PythonScript(
    E=lecture_output.E,
    G=lecture_output.G,
    a=lecture_output.a,
    b=lecture_output.b,
    L_x=lecture_output.x,
    L_x_bar=lecture_output.x_bar,
    L_theta=lecture_output.theta,
    L_theta_bar=lecture_output.theta_bar,
    L_u_0=lecture_output.u_0,
    L_u_0_bar=lecture_output.u_0_bar,
    zoom_rendu=grossissement)  # -> out, geom_bar, geom, Mtorsion, Mflex1, Mflex2; inputs L_x: list, L_x_bar: list, L_theta: list, L_theta_bar: list, L_u_0: list, L_u_0_bar: list
# ---------- rendu: Python ----------
from math import*
import rhinoscriptsyntax as rs

################################################################################
#                    Fonctions pour le calcul vectoriel                        #
################################################################################

#Fonctions basiques
def VectorAdd(v1, v2) :
    return (v1[0]+v2[0], v1[1]+v2[1], v1[2]+v2[2])
def VectorSubtract2D(v1, v2) :
    return (v1[0]-v2[0], v1[1]-v2[1])
def VectorSubtract(v1, v2) :
    return (v1[0]-v2[0], v1[1]-v2[1], v1[2]-v2[2])
def VectorLength(v) :
    return (v[0]*v[0]+v[1]*v[1]+v[2]*v[2])**0.5
def VectorScale(v, l) :
    return (l*v[0], l*v[1], l*v[2])
def VectorUnitize(v) :
    l = VectorLength(v)
    if l>0 :
        return VectorScale(v, 1/VectorLength(v))
    else :
        return (0,0,0)
def VectorDotProduct(v1, v2) :
    return v1[0]*v2[0]+v1[1]*v2[1]+v1[2]*v2[2]
def VectorCrossProduct(v1, v2) :
    return (v1[1]*v2[2]-v1[2]*v2[1], v2[0]*v1[2]-v2[2]*v1[0], v1[0]*v2[1]-v1[1]*v2[0])

#Rotation du vecteur v avec un vecteur de rotation rot
def VectorRotate(v, rot) :
    ang = VectorLength(rot)
    if ang == 0 :
        return v
    vx, vy, vz = v
    nx, ny, nz = VectorUnitize(rot)
    co = cos(ang)
    si = sin(ang)
    return (vx*co + (1-co)*(vx*nx*nx + vy*nx*ny + vz*nx*nz) +si*(ny*vz-nz*vy),\
            vy*co + (1-co)*(vx*nx*ny + vy*ny*ny + vz*ny*nz) +si*(nz*vx-nx*vz),\
            vz*co + (1-co)*(vx*nx*nz + vy*ny*nz + vz*nz*nz) +si*(nx*vy-ny*vx))

#Angle orienté entre deux vecteur v1 et v2 autour de l'axe axis
def VectorAngle(vect1, vect2, axis) :
    if VectorLength(axis) == 0.0 :
        return 0.0
    return asin(VectorDotProduct(axis, VectorCrossProduct(vect1, vect2))/\
        (VectorLength(axis)*VectorLength(vect1)*VectorLength(vect2)))

#Combinaison linéaire de deux vecteurs
def VectorLinearComb(v1, v2, l1, l2) :
    return (l1*v1[0]+l2*v2[0],l1*v1[1]+l2*v2[1],l1*v1[2]+l2*v2[2])

################################################################################
#                        Fonction pour le calcul de J                          #
################################################################################

def computeJ(a, b) :
    res = 0
    ab = a/b
    ba = b/a
    for i in range(100) :
        n = 2*i+1
        for j in range(100) :
            m=2*j+1
            res += (ab/(n*n) + ba/(m*m))/(((n/a)**2+(m/b)**2)**2)
    return 256*res/pi**6

################################################################################
#             Fonction pour le calcul des propriétés géométriques              #
################################################################################

def proprietes_geometriques(x, theta, u_0, omega_bar, B) :
    #calcul de e et L
    e = []
    L = []
    for i in range(N-1) :
        e.append(VectorSubtract(x[i+1], x[i]))
        L.append(VectorLength(e[i]))
    
    #calcul de Kb
    Kb = [(0,0,0)]
    for i in range(1,N-1) :
        Kb.append(VectorScale(VectorCrossProduct(e[i-1], e[i]),2.0/\
            (L[i-1]*L[i]*VectorLength(VectorAdd(e[i-1],e[i])))))
    Kb.append((0,0,0))

    #calcul du repère de Bishop (u,v)
    u = []
    v = []
    v.append(VectorUnitize(VectorCrossProduct(e[0],u_0)))
    u.append(VectorUnitize(VectorCrossProduct(v[0],e[0])))
    bi_ = (0,0,0) #b[i-1]
    Ki_ = 0       #K[i-1]
    for i in range(1,N-1) :
        bi = VectorUnitize(Kb[i])
        Ki = VectorLength(Kb[i])
        u.append(VectorRotate(VectorRotate(u[i-1], VectorScale(bi_,\
            asin(L[i-1]*Ki_/2))), VectorScale(bi, asin(L[i-1]*Ki/2))))
        v.append(VectorRotate(VectorRotate(v[i-1], VectorScale(bi_,\
            asin(L[i-1]*Ki_/2))), VectorScale(bi, asin(L[i-1]*Ki/2))))
        bi_ = bi
        Ki_ = Ki
    u.append(VectorRotate(u[N-2], VectorScale(bi_, asin(L[N-2]*Ki_/2))))
    v.append(VectorRotate(v[N-2], VectorScale(bi_, asin(L[N-2]*Ki_/2))))
    
    #calcul de d1, d2
    d1 = []
    d2 = []
    for i in range(N) :
        d1.append(VectorLinearComb(u[i], v[i], cos(theta[i]), sin(theta[i])))
        d2.append(VectorLinearComb(u[i], v[i], -sin(theta[i]), cos(theta[i])))

    #calcul de omega
    omega = []
    for i in range(N) :
        omega.append((VectorDotProduct(Kb[i],d2[i]), -VectorDotProduct(Kb[i],d1[i])))
    
    #calcul de theta' ( theta_prime[i] = theta_{i+1/2}' )
    theta_prime = []
    for i in range(N-1) :
        theta_prime.append((theta[i+1]-theta[i])/L[i])
    
    #calcul de M et r
    M = []
    r = []
    for i in range(N) :
        M.append(VectorLinearComb(d1[i], d2[i], -B[0]*(omega[i][0]-omega_bar[i][0]),\
                                   -B[1]*(omega[i][1]-omega_bar[i][1])))
        r.append(omega[i][0]*(omega[i][1]-omega_bar[i][1])*B[1]-\
                  omega[i][1]*(omega[i][0]-omega_bar[i][0])*B[0])
    
    return (e, L, u, v, d1, d2, Kb, omega, theta_prime, M, r)

################################################################################
#                        Fonctions pour le rendu                               #
################################################################################

#Fonction pour la création d'une section
def section(x, d1, d2, a, b, zoom_rendu) :
    A = VectorAdd(x, VectorLinearComb(d1, d2, a*0.5*zoom_rendu, b*0.5*zoom_rendu))
    B = VectorAdd(x, VectorLinearComb(d1, d2, -a*0.5*zoom_rendu, b*0.5*zoom_rendu))
    C = VectorAdd(x, VectorLinearComb(d1, d2, -a*0.5*zoom_rendu, -b*0.5*zoom_rendu))
    D = VectorAdd(x, VectorLinearComb(d1, d2, a*0.5*zoom_rendu, -b*0.5*zoom_rendu))
    return rs.AddCurve([A,B,C,D,A],1)

def rendu(x, a, b, d1, d2, zoom_rendu) :
    geom = []
    for i in range(N-1) :
        sec1 = section(x[i], d1[i], d2[i], a, b, zoom_rendu)
        sec2 = section(x[i+1], d1[i+1], d2[i+1], a, b, zoom_rendu)
        geom.append(rs.AddSweep1(rs.AddCurve([x[i], x[i+1]],1), [sec1,sec2])[0])
    return geom

def valeurs(beta, theta_prime, B, omega, omega_bar) :
    Mtorsion = []
    Mflex1 = []
    Mflex2 = []
    for i in range(N-1) :
        Mtorsion.append(beta*theta_prime[i])
        Mflex1.append(0.5*B[0]*(omega[i][0]-omega_bar[i][0]+omega[i+1][0]-omega_bar[i+1][0]))
        Mflex2.append(0.5*B[1]*(omega[i][1]-omega_bar[i][1]+omega[i+1][1]-omega_bar[i+1][1]))
    return (Mtorsion, Mflex1, Mflex2)

################################################################################
#                                     MAIN                                     #
################################################################################

#Propriétés mécaniques
A = E*a*b
B = (E*a*a*a*b/12, E*a*b*b*b/12)
beta = G*computeJ(a,b)

geom = []
geom_bar = []
Mtorsion = []
Mflex1 = []
Mflex2 = []

N = len(L_x[0])
x = L_x[0]
x_bar = L_x_bar[0]
theta = L_theta[0]
theta_bar = L_theta_bar[0]
u_0 = L_u_0[0]
u_0_bar = L_u_0_bar[0]
for i, val in enumerate(L_x_bar) :
    N = len(L_x[i])
    x = L_x[i]
    x_bar = L_x_bar[i]
    theta = L_theta[i]
    theta_bar = L_theta_bar[i]
    u_0 = L_u_0[i]
    u_0_bar = L_u_0_bar[i]
    d1_bar, d2_bar, Kb, omega_bar = proprietes_geometriques(x_bar, theta_bar, u_0_bar, [(0,0)]*N, B)[4:8]
    e, L, u, v, d1, d2, Kb, omega, theta_prime, M, r = proprietes_geometriques(x, theta, u_0, omega_bar, B)
    geom_bar_temp = rendu(x_bar, a, b, d1_bar, d2_bar, zoom_rendu)
    geom_temp = rendu(x, a, b, d1, d2, zoom_rendu)
    Mtorsion_temp, Mflex1_temp, Mflex2_temp = valeurs(beta, theta_prime, B, omega, omega_bar)
    for j in range(N-1) :
        geom_bar.append(geom_bar_temp[j])
        geom.append(geom_temp[j])
        Mtorsion.append(Mtorsion_temp[j])
        Mflex1.append(Mflex1_temp[j])
        Mflex2.append(Mflex2_temp[j])
# ---------- end rendu ----------
python_2 = PythonScript(x_list=lecture_output.x)  # -> polylines; inputs x_list: list
# ---------- python_2: Python ----------
import rhinoscriptsyntax as rs

polylines = []
for x in x_list:
    pts=[]
    for pt in x:
        pts.append(rs.AddPoint(pt[0],pt[1],pt[2]))
        
    polylines.append(rs.AddPolyline(pts))
# ---------- end python_2 ----------
critère = ValueList({"Q": 0, "M1": 1, "M2": 2}, selected="M1")
filter = StreamFilter(Gate=critère, Stream0=rendu.Mtorsion, Stream1=rendu.Mflex1, Stream2=rendu.Mflex2)

# ----
intcrv = Interpolate(Vertices=sections_0, Degree=3, Periodic=False, KnotStyle=1)  # -> Curve, Length, Domain
cp = ControlPoints(Curve=python_2)  # -> Points, Weights, Knots
intcrv_2 = Interpolate(Vertices=cp.Points, Degree=3, Periodic=False, KnotStyle=1)  # -> Curve, Length, Domain

list_2 = ValueList({"Free": 0, "Pinned": 1, "Clamped": 2}, selected="Clamped")
list_3 = ValueList({"Free": 0, "Pinned": 1, "Clamped": 2}, selected="Free")
button = Button()

# ---- group: Génération du fichier INPUT
panel_2 = Panel("20000")
c_script = CSharpScript(
    mframe_0=sections_0,
    mframe=sections_i,
    w=section_b1_3,
    h=section_b2_3,
    iteration_max=panel_2,
    cvg="10",
    Reference="Z:\Github\BRelax\src\BRelaxCommon\bin\BRelaxCommon.dll")  # -> out, input; inputs mframe_0: list of Plane, mframe: list of Plane, w: Double, h: Double, iteration_max: Int32, cvg: Double; disabled
# ---------- c_script: C# ----------
    double E = 26e9;
    double G = 3e9;

    string str = "";

    str += BRelaxAPI.GetMaterial("mat.gfrp", E, G);
    str += Environment.NewLine + Environment.NewLine;

    str += BRelaxAPI.GetRectangularProfile("prof.rect", w, h);
    str += Environment.NewLine + Environment.NewLine;

    str += BRelaxAPI.GetSection("s.rect", "mat.gfrp", "prof.rect");
    str += Environment.NewLine + Environment.NewLine;

    str += BRelaxAPI.GetClampedBoundary("bc.start", mframe[0].ZAxis);
    str += Environment.NewLine;
    str += BRelaxAPI.GetClampedBoundary("bc.end", mframe[mframe.Count - 1].ZAxis);
    str += Environment.NewLine + Environment.NewLine;

    str += BRelaxAPI.GetBeam("beam.1", "s.rect", "bc.start", "bc.end", mframe.ToArray(), mframe_0.ToArray());
    str += Environment.NewLine + Environment.NewLine;

    str += BRelaxAPI.GetConvergence(iteration_max, cvg);
    str += Environment.NewLine + Environment.NewLine;

    input = str;
# ---------- end c_script ----------
panel_3 = Panel(c_script.input)

# ---- group: Display BRelax Results / Convergence
# Doubleclick Me!
python_3 = PythonScript(nbIter=lecture_output.nbIter, iter_max=panel_2)  # -> out, R, G, B, text
# ---------- python_3: Python ----------
import rhinoscriptsyntax as rs
if iter_max > nbIter :
    R = 20
    G = 148
    B = 20
    text = "Convergence"
else :
    R = 255
    G = 0
    B = 0
    text = "Pas de convergence"
# ---------- end python_3 ----------
rgb = ColourRGB(Alpha=255, Red=python_3.R, Green=python_3.G, Blue=python_3.B)
legend = Legend(Colour=rgb, Tags=python_3.text, LegendType=1)

# ----
L = ColourSwatch(SwatchColor=RGB(0, 0, 255))
R = ColourSwatch(SwatchColor=RGB(255, 0, 0))
G = ColourSwatch(SwatchColor=RGB(0, 0, 0))

simple_beam_2 = SimpleBeam2(
    RestPosition=sections_0,
    InitialPosition=sections_i,
    SectionB1=section_b1_3,
    SectionB2=section_b2_3,
    BoundaryConditionAtStart=list_2,
    BoundaryConditionAtEnd=list_3,
    Iteration_max="20000",
    Reset=Toggle(False),
    IsBase=False)  # -> info, index, l_0, kb_0, k1_0, k2_0, twist_0, tau_0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
ma = MassAddition(Input=simple_beam_2.twist)  # -> Result, PartialResults
addition = Addition(A=simple_beam_2.Rθ_M, B=simple_beam_2.Rθ_Q)
ins = InsertItems(List=ma.PartialResults, Item=0, Indices=0, Wrap=True)
num = Number(simple_beam_2.M_g)
panel_4 = Panel(simple_beam_2.mext)
vdis_2 = VectorDisplay(Anchor=simple_beam_2.sections, Vector=expr("x/5", simple_beam_2.t))
sections = Plane(simple_beam_2.sections)

kb_h_l = Vector(simple_beam_2.kb_h_l)
kb_g = Vector(simple_beam_2.kb_g)
kb_h_r = Vector(simple_beam_2.kb_h_r)

fext = Vector(simple_beam_2.Fext)
mext = Vector(simple_beam_2.Mext)
fr = Vector(simple_beam_2.Fr)
mr = Vector(simple_beam_2.Mr)

fext_2 = Vector(simple_beam_2.fext)
mext_2 = Vector(simple_beam_2.mext)

m_g = Vector(simple_beam_2.M_g)
m_h_r = Vector(simple_beam_2.M_h_r)
m_h_l = Vector(simple_beam_2.M_h_l)

Q = Number(simple_beam_2.Q)
q_l = Number(simple_beam_2.Q_l)
q_r = Number(simple_beam_2.Q_r)

panel_5 = Panel(q_r)

v_m_h_r = Vector(simple_beam_2.V_M_h_r)
v_m_g = Vector(simple_beam_2.V_M_g)
v_m_h_l = Vector(simple_beam_2.V_M_h_l)

rx_axial = Vector(simple_beam_2.Rx_axial)
rθ_q = Number(simple_beam_2.Rθ_Q)
rx_shear_m = Vector(simple_beam_2.Rx_shear_M)
rx_shear_q = Vector(simple_beam_2.Rx_shear_Q)
rθ_m = Number(simple_beam_2.Rθ_M)

N_3 = Number(simple_beam_2.N)
n_l = Number(simple_beam_2.N_l)
n_r = Number(simple_beam_2.N_r)

Y = UnitY(Factor=ins)
cull_i = CullIndex(List=N_3, Indices=-1, Wrap=True)
cull_i_2 = CullIndex(List=N_3, Indices=0, Wrap=True)
pt = Point(sections)
multiplication = Multiplication(A=Y, B=5)
subtraction_2 = Subtraction(A=cull_i, B=cull_i_2)
move = Move(Geometry=pt, Motion=multiplication)  # -> Geometry, Transform

intcrv_3 = Interpolate(Vertices=sections, Degree=3, Periodic=False, KnotStyle=1)  # -> Curve, Length, Domain
python_4 = PythonScript(mframe=sections)  # -> mframe_h, mframe_g; inputs mframe: list of Plane
# ---------- python_4: Python ----------
import rhinoscriptsyntax as rs

Nn = len(mframe)
ne_h = int((Nn-1)/2)
print ne_h

mframe_h = []
mframe_g = []

mframe_h.append(mframe[0])
for i in range(ne_h):
    mframe_h.append(mframe[2*i])
    mframe_g.append(mframe[2*i-1])
# ---------- end python_4 ----------
centerline = Curve(intcrv_3.Curve)
mframe_h = Plane(python_4.mframe_h)
mframe_g = Plane(python_4.mframe_g)
sph = Sphere(Base=mframe_h, Radius=0.07)
preview = CustomPreview(Geometry=sph, Shader=G)

list_4 = ValueList({"custom scale": 0, "autoscale (local)": 1, "autoscale (global)": 2}, selected="autoscale (global)")
autoscale_vectors = Vector([rx_axial, rx_shear_m, rx_shear_q])
sections_2 = Plane(sections)
r_axial = VectorDisplay(
    frame=sections_2,
    display_vectors=rx_axial,
    autoscale_vectors=autoscale_vectors,
    color=RGB(255, 255, 0),
    weight="2",
    scale="1",
    autoscale=list_4)
r_shear_m = VectorDisplay(
    frame=sections_2,
    display_vectors=rx_shear_m,
    autoscale_vectors=autoscale_vectors,
    color=RGB(255, 255, 0),
    weight="2",
    scale="1",
    autoscale=list_4)
r_shear_q = VectorDisplay(
    frame=sections_2,
    display_vectors=rx_shear_q,
    autoscale_vectors=autoscale_vectors,
    color=RGB(255, 255, 0),
    weight="2",
    scale="1",
    autoscale=list_4)

scale = Panel("2")
sections_3 = Plane(sections)

# ---- group: Courbure calculée par DR
python_5 = PythonScript(mframe=sections_3, k_g=kb_g, k_h_l=kb_h_l, k_h_r=kb_h_r, scale=scale)  # -> out, kb, k1, k2; inputs mframe: list of Plane, k_g: list of Vector3d, k_h_l: list of Vector3d, k_h_r: list of Vector3d
# ---------- python_5: Python ----------
import rhinoscriptsyntax as rs
import Rhino as rh

Nn = len(mframe)
e = []
l = []
ll = []
for i in range(0,Nn-2):
    e.append(rs.VectorCreate(mframe[i+1].Origin, mframe[i].Origin))
    l.append(e[-1].Length)
    ll.append(rs.Distance(mframe[i+2].Origin, mframe[i].Origin))
e.append(rs.VectorCreate(mframe[Nn-1].Origin, mframe[Nn-2].Origin))
l.append(e[-1].Length)

kb = []
kb.append(2/(l[0]*l[0])*rs.VectorCrossProduct(mframe[0].ZAxis,e[0]))
for i in range(1, Nn-1):
    kb.append(2/(l[i-1]*l[i]*ll[i-1])*rs.VectorCrossProduct(e[i-1],e[i]))
kb.append(2/(l[Nn-2]*l[Nn-2])*rs.VectorCrossProduct(e[Nn-2],mframe[Nn-1].ZAxis))


# determine le max global
max = 0
for v in k_g:
    if v.Length > max: max = v.Length
for v in k_h_l:
    if v.Length > max: max = v.Length
for v in k_h_r:
    if v.Length > max: max = v.Length
for v in kb:
    if v.Length > max: max = v.Length


scale = scale / max

lb = []
for i in range(len(kb)):
    vec = scale * kb[i]
    pt = mframe[i].Origin
    kb[i] = (pt+vec)
    lb.append(rh.Geometry.Line(pt, kb[i]))
    


k1 = []
l1 = []
for i in range(len(k_g)):
    
    # projection de k_h_r
    vec = scale * rs.VectorDotProduct(k_h_r[i], mframe[2*i].XAxis) * mframe[2*i].YAxis
    pt = mframe[2*i].Origin
    k1.append(pt+vec)
    l1.append(rh.Geometry.Line(pt, k1[-1]))
    
    # projection de k_g
    vec = scale * rs.VectorDotProduct(k_g[i], mframe[2*i+1].XAxis) * mframe[2*i+1].YAxis
    pt = mframe[2*i+1].Origin
    k1.append(pt+vec)
    l1.append(rh.Geometry.Line(pt, k1[-1]))
    
    # projection de k_h_l
    vec = scale * rs.VectorDotProduct(k_h_l[i+1], mframe[2*i+2].XAxis) * mframe[2*i+2].YAxis
    pt = mframe[2*i+2].Origin
    k1.append(pt+vec)
    l1.append(rh.Geometry.Line(pt, k1[-1]))

k2 = []
l2 = []
for i in range(len(k_g)):
    
    # projection de k_h_r
    vec = scale * rs.VectorDotProduct(k_h_r[i], mframe[2*i].YAxis) * mframe[2*i].XAxis
    pt = mframe[2*i].Origin
    k2.append(pt+vec)
    l2.append(rh.Geometry.Line(pt, k2[-1]))
    
    # projection de k_g
    vec = scale * rs.VectorDotProduct(k_g[i], mframe[2*i+1].YAxis) * mframe[2*i+1].XAxis
    pt = mframe[2*i+1].Origin
    k2.append(pt+vec)
    l2.append(rh.Geometry.Line(pt, k2[-1]))
    
    # projection de k_h_l
    vec = scale * rs.VectorDotProduct(k_h_l[i+1], mframe[2*i+2].YAxis) * mframe[2*i+2].XAxis
    pt = mframe[2*i+2].Origin
    k2.append(pt+vec)
    l2.append(rh.Geometry.Line(pt, k2[-1]))

kb = [rs.AddPolyline(kb)]
kb.extend(lb)

k1 = [rs.AddPolyline(k1)]
k1.extend(l1)

k2 = [rs.AddPolyline(k2)]
k2.extend(l2)
# ---------- end python_5 ----------
swatch = ColourSwatch(SwatchColor=RGB(0, 255, 0))
preview_2 = CustomPreview(Geometry=[python_5.k1, python_5.k2], Shader=swatch)
preview_3 = CustomPreview(Geometry=python_5.kb, Shader=swatch)

# ---- group: Torsion calculée par DR
python_6 = PythonScript(mframe=sections_3, Q_l=q_l, Q_r=q_r, scale=scale)  # -> out, Q; inputs mframe: list of Plane, Q_l: list, Q_r: list
# ---------- python_6: Python ----------
import rhinoscriptsyntax as rs
import Rhino as rh

dir = rh.Geometry.Vector3d(0,1,0)

# determine le max global
max = 0
for v in Q_l:
    if abs(v) > max: max = abs(v)
for v in Q_r:
    if abs(v) > max: max = abs(v)

if max > 0:
    scale = scale / max
    
    Q = []
    l = []
    for i in range(len(mframe)-1):
        dir = mframe[i].XAxis
        # projection de Q_r
        vec = (scale * Q_r[i]) * rh.Geometry.Vector3d.CrossProduct(mframe[i].ZAxis,dir)
        pt = mframe[i].Origin
        Q.append(pt+vec)
        l.append(rh.Geometry.Line(pt, Q[-1]))
        
        # projection de Q_l
        dir = mframe[i+1].XAxis
        vec = (scale * Q_l[i+1]) * rh.Geometry.Vector3d.CrossProduct(mframe[i+1].ZAxis,dir)
        pt = mframe[i+1].Origin
        Q.append(pt+vec)
        l.append(rh.Geometry.Line(pt, Q[-1]))
        
    Q = [rs.AddPolyline(Q)]
    Q.extend(l)
# ---------- end python_6 ----------
preview_4 = CustomPreview(Geometry=python_6.Q, Shader=ColourSwatch(SwatchColor=RGB(255, 255, 255)))

# ---- group: Moments calculés par DR
python_7 = PythonScript(mframe=sections_3, M_g=m_g, M_h_l=m_h_l, M_h_r=m_h_r, scale=scale)  # -> out, M1, M2; inputs mframe: list of Plane, M_g: list of Vector3d, M_h_l: list of Vector3d, M_h_r: list of Vector3d
# ---------- python_7: Python ----------
import rhinoscriptsyntax as rs
import Rhino as rh

# determine le max global
max = 0
for v in M_g:
    if v.Length > max: max = v.Length
for v in M_h_l:
    if v.Length > max: max = v.Length
for v in M_h_r:
    if v.Length > max: max = v.Length

scale = scale / max

M1 = []
l1 = []
for i in range(len(M_g)):
    
    # projection de M_h_r
    vec = scale * rs.VectorDotProduct(M_h_r[i], mframe[2*i].XAxis) * mframe[2*i].YAxis
    pt = mframe[2*i].Origin
    M1.append(pt+vec)
    l1.append(rh.Geometry.Line(pt, M1[-1]))
    
    # projection de M_g
    vec = scale * rs.VectorDotProduct(M_g[i], mframe[2*i+1].XAxis) * mframe[2*i+1].YAxis
    pt = mframe[2*i+1].Origin
    M1.append(pt+vec)
    l1.append(rh.Geometry.Line(pt, M1[-1]))
    
    # projection de M_h_l
    vec = scale * rs.VectorDotProduct(M_h_l[i+1], mframe[2*i+2].XAxis) * mframe[2*i+2].YAxis
    pt = mframe[2*i+2].Origin
    M1.append(pt+vec)
    l1.append(rh.Geometry.Line(pt, M1[-1]))

M2 = []
l2 = []
for i in range(len(M_g)):
    
    # projection de M_h_r
    vec = scale * rs.VectorDotProduct(M_h_r[i], mframe[2*i].YAxis) * mframe[2*i].XAxis
    pt = mframe[2*i].Origin
    M2.append(pt+vec)
    l2.append(rh.Geometry.Line(pt, M2[-1]))
    
    # projection de M_g
    vec = scale * rs.VectorDotProduct(M_g[i], mframe[2*i+1].YAxis) * mframe[2*i+1].XAxis
    pt = mframe[2*i+1].Origin
    M2.append(pt+vec)
    l2.append(rh.Geometry.Line(pt, M2[-1]))
    
    # projection de M_h_l
    vec = scale * rs.VectorDotProduct(M_h_l[i+1], mframe[2*i+2].YAxis) * mframe[2*i+2].XAxis
    pt = mframe[2*i+2].Origin
    M2.append(pt+vec)
    l2.append(rh.Geometry.Line(pt, M2[-1]))
    
M1 = [rs.AddPolyline(M1)]
M1.extend(l1)

M2 = [rs.AddPolyline(M2)]
M2.extend(l2)
# ---------- end python_7 ----------
preview_5 = CustomPreview(Geometry=[python_7.M1, python_7.M2], Shader=ColourSwatch(SwatchColor=RGB(255, 255, 0)))

# ---- group: Effort Tranchant calculés par DR
python_8 = PythonScript(mframe=sections_3, V_M_g=v_m_g, V_M_h_l=v_m_h_l, V_M_h_r=v_m_h_r, scale=scale)  # -> out, V1, V2; inputs mframe: list of Plane, V_M_g: list of Vector3d, V_M_h_l: list of Vector3d, V_M_h_r: list of Vector3d
# ---------- python_8: Python ----------
import rhinoscriptsyntax as rs
import Rhino as rh

# determine le max global
max = 0
for v in V_M_g:
    if v.Length > max: max = v.Length
for v in V_M_h_l:
    if v.Length > max: max = v.Length
for v in V_M_h_r:
    if v.Length > max: max = v.Length

scale = scale / max

V1 = []
l1 = []
for i in range(len(V_M_g)):
    
    # projection de V_M_h_r
    vec = scale * rs.VectorDotProduct(V_M_h_r[i], mframe[2*i].XAxis) * mframe[2*i].XAxis
    pt = mframe[2*i].Origin
    V1.append(pt+vec)
    l1.append(rh.Geometry.Line(pt, V1[-1]))
    
    # projection de V_M_g
    vec = scale * rs.VectorDotProduct(V_M_g[i], mframe[2*i+1].XAxis) * mframe[2*i+1].XAxis
    pt = mframe[2*i+1].Origin
    V1.append(pt+vec)
    l1.append(rh.Geometry.Line(pt, V1[-1]))
    
    # projection de V_M_h_l
    vec = scale * rs.VectorDotProduct(V_M_h_l[i+1], mframe[2*i+2].XAxis) * mframe[2*i+2].XAxis
    pt = mframe[2*i+2].Origin
    V1.append(pt+vec)
    l1.append(rh.Geometry.Line(pt, V1[-1]))
    print l1[-1].Length
    
V2 = []
l2 = []
for i in range(len(V_M_g)):
    
    # projection de V_M_h_r
    vec = scale * rs.VectorDotProduct(V_M_h_r[i], mframe[2*i].YAxis) * mframe[2*i].YAxis
    pt = mframe[2*i].Origin
    V2.append(pt+vec)
    l2.append(rh.Geometry.Line(pt, V2[-1]))
    
    # projection de V_M_g
    vec = scale * rs.VectorDotProduct(V_M_g[i], mframe[2*i+1].YAxis) * mframe[2*i+1].YAxis
    pt = mframe[2*i+1].Origin
    V2.append(pt+vec)
    l2.append(rh.Geometry.Line(pt, V2[-1]))
    
    # projection de V_M_h_l
    vec = scale * rs.VectorDotProduct(V_M_h_l[i+1], mframe[2*i+2].YAxis) * mframe[2*i+2].YAxis
    pt = mframe[2*i+2].Origin
    V2.append(pt+vec)
    l2.append(rh.Geometry.Line(pt, V2[-1]))
    
    
V1 = [rs.AddPolyline(V1)]
V1.extend(l1)

V2 = [rs.AddPolyline(V2)]
V2.extend(l2)
# ---------- end python_8 ----------
preview_6 = CustomPreview(Geometry=[python_8.V1, python_8.V2], Shader=ColourSwatch(SwatchColor=RGB(255, 0, 255)))

# ---- group: Torsion calculée par DR
python_9 = PythonScript(mframe=sections_3, N_l=n_l, N_r=n_r, scale=scale)  # -> out, N; inputs mframe: list of Plane, N_l: list, N_r: list
# ---------- python_9: Python ----------
import rhinoscriptsyntax as rs
import Rhino as rh

dir = rh.Geometry.Vector3d(0,1,0)

# determine le max global
max = 0
for v in N_l:
    if abs(v) > max: max = abs(v)
for v in N_r:
    if abs(v) > max: max = abs(v)

if max > 0:
    scale = scale / max
    
    N = []
    l = []
    for i in range(len(mframe)-1):
        dir = mframe[i].XAxis
        # projection de N_r
        vec = (scale * N_r[i]) * rh.Geometry.Vector3d.CrossProduct(mframe[i].ZAxis,dir)
        pt = mframe[i].Origin
        N.append(pt+vec)
        l.append(rh.Geometry.Line(pt, N[-1]))
        
        # projection de N_l
        dir = mframe[i+1].XAxis
        vec = (scale * N_l[i+1]) * rh.Geometry.Vector3d.CrossProduct(mframe[i+1].ZAxis,dir)
        pt = mframe[i+1].Origin
        N.append(pt+vec)
        l.append(rh.Geometry.Line(pt, N[-1]))
        
    N = [rs.AddPolyline(N)]
    N.extend(l)
# ---------- end python_9 ----------
preview_7 = CustomPreview(Geometry=python_9.N, Shader=ColourSwatch(SwatchColor=RGB(255, 0, 255)))

# ----
scale_2 = Panel("2e2")

# ---- group: courbure 3pts théorique discontinue
sections_4 = Plane(sections)
pt_2 = Point(sections_4)
python_10 = PythonScript(pts=pt_2)  # -> out, ps, p, pe, e1, e2, ph, pg, kb_h; inputs pts: list of Point3d
# ---------- python_10: Python ----------
import rhinoscriptsyntax as rs

Nn = len(pts)
ne_h = int((Nn-1)/2)
print ne_h

ps = []
p = []
pe = []
e1 = []
e2 = []
ph = [pts[0]]

for i in range(ne_h):
    ps.append(pts[2*i])
    p.append(pts[2*i+1])
    pe.append(pts[2*i+2])
    e1.append(rs.VectorCreate(pts[2*i+1], pts[2*i]))
    e2.append(rs.VectorCreate(pts[2*i+2], pts[2*i+1]))
    ph.append(pts[2*i+2])


kb_h = []
# ---------- end python_10 ----------
python_11 = PythonScript(e1=python_10.e1, e2=python_10.e2)  # -> out, kb_h_l, kb_h_r; inputs ts: list of Vector3d, te: list of Vector3d, e1: list of Vector3d, e2: list of Vector3d
# ---------- python_11: Python ----------
import rhinoscriptsyntax as rs

kb_h_r = []
kb_h_l = []

kb_h_l.append(rs.VectorCreate((0,0,0),(0,0,0)))

for i in range(len(ts)):
    
    l1 = e1[i].Length
    l2 = e2[i].Length
    
    kb_h_r.append(2/(l1*l1) * rs.VectorCrossProduct(ts[i],e1[i]))
    kb_h_l.append(2/(l2*l2) * rs.VectorCrossProduct(e2[i],te[i]))

kb_h_r.append(rs.VectorCreate((0,0,0),(0,0,0)))
# ---------- end python_11 ----------
python_12 = PythonScript(mframe=sections_4, kb_h_l=python_11.kb_h_l, kb_h_r=python_11.kb_h_r, scale=scale_2)  # -> out, k1, k2; inputs mframe: list of Plane, kb_g: list of Vector3d, kb_h_l: list of Vector3d, kb_h_r: list of Vector3d
# ---------- python_12: Python ----------
import rhinoscriptsyntax as rs


k1 = []
for i in range(len(kb_g)):
    
    # projection de kb_h_r
    vec = scale * rs.VectorDotProduct(kb_h_r[i], mframe[2*i].XAxis) * mframe[2*i].XAxis
    pt = mframe[2*i].Origin
    k1.append(pt+vec)
    
    # projection de kb_g
    vec = scale * rs.VectorDotProduct(kb_g[i], mframe[2*i+1].XAxis) * mframe[2*i+1].XAxis
    pt = mframe[2*i+1].Origin
    k1.append(pt+vec)
    
    # projection de kb_h_l
    vec = scale * rs.VectorDotProduct(kb_h_l[i+1], mframe[2*i+2].XAxis) * mframe[2*i+2].XAxis
    pt = mframe[2*i+2].Origin
    k1.append(pt+vec)



k2 = []
for i in range(len(kb_g)):
    
    # projection de kb_h_r
    vec = scale * rs.VectorDotProduct(kb_h_r[i], mframe[2*i].YAxis) * mframe[2*i].YAxis
    pt = mframe[2*i].Origin
    k2.append(pt+vec)
    
    # projection de kb_g
    vec = scale * rs.VectorDotProduct(kb_g[i], mframe[2*i+1].YAxis) * mframe[2*i+1].YAxis
    pt = mframe[2*i+1].Origin
    k2.append(pt+vec)
    
    # projection de kb_h_l
    vec = scale * rs.VectorDotProduct(kb_h_l[i+1], mframe[2*i+2].YAxis) * mframe[2*i+2].YAxis
    pt = mframe[2*i+2].Origin
    k2.append(pt+vec)
    
k1 = rs.AddPolyline(k1)
k2 = rs.AddPolyline(k2)
# ---------- end python_12 ----------
preview_8 = CustomPreview(Geometry=python_12.k2, Shader=ColourSwatch(SwatchColor=RGB(255, 255, 0)))

# ---- group: Fext and fext Visualisation
filter_fext = PythonScript(mframe=sections, l0=simple_beam_2.l_0, Fext=fext, fext=fext_2)  # -> out, Fext, fext; inputs mframe: list of Plane, l0: list, Fext: list of Vector3d, fext: list of Vector3d
# ---------- filter_fext: Python ----------
import rhinoscriptsyntax as rs
import Rhino.Geometry as rg
# com fext est fusionné dans Fext pour les calculs, on filtre fext pour 
#revenir au Fext d'origine

n = len(mframe)

# i = 0
Fext[0] -= 0.5*l0[0]*fext[0]

# i = 1 .. n-2
for i in range(1,n-1):
    Fext[i] -= 0.5*l0[i-1]*fext[i-1] + 0.5*l0[i]*fext[i]

# i = n-1
Fext[n-1] -= 0.5*l0[n-2]*fext[n-2]
# ---------- end filter_fext ----------
scale_3 = Panel("3")
fext_and_fext = PythonScript(mframe=sections, l0=simple_beam_2.l_0, Fext=filter_fext.Fext, fext=filter_fext.fext, scale=scale_3)  # -> out, pt, Fx, Fy, Fz, fx, fx_p, fx_t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; inputs mframe: list of Plane, l0: list, Fext: list of Vector3d, fext: list of Vector3d
# ---------- fext_and_fext: Python ----------
import rhinoscriptsyntax as rs
import Rhino.Geometry as rg 

offset = 0.2
epsilon = 1e-2
n = len(mframe)

# determine le max global
max = 0
for v in Fext:
    if v.Length > max: max = v.Length
for v in fext:
    if v.Length > max: max = v.Length

scale = scale / max

ux = rg.Vector3d(1,0,0)
uy = rg.Vector3d(0,1,0)
uz = rg.Vector3d(0,0,1)

pt = []
Fx = []
Fy = []
Fz = []

fx = []
fy = []
fz = []

for i in range(n):
    pt.append(mframe[i].Origin)
    Fx.append(scale * Fext[i].X * ux)
    Fy.append(scale * Fext[i].Y * uy)
    Fz.append(scale * Fext[i].Z * uz)


p = []


def fextInfo(fext, u, udir):
    fu = []
    pts = []
    label_txt = []
    label_pt = []
    for i in range(n-1):
        # polyline
        fu.append(scale * 0.5 * l0[i] * (fext[i] * u) * udir)
        pts.append(mframe[i].Origin)
        pts.append(mframe[i].Origin + fu[-1])
        pts.append(mframe[i+1].Origin + fu[-1])
        pts.append(mframe[i+1].Origin)
        
        # label
        dir = rg.Vector3d(fu[-1])
        pt = 0.5*(mframe[i].Origin + mframe[i+1].Origin)
        
        label_pt.append(pt + (dir.Length + offset) * dir/dir.Length)
        val = fext[i] * u
        if abs(val) > epsilon: label_txt.append(str(round(val,2)) + " N/m")
        else:  label_txt.append("")
    return [rs.AddPolyline(pts), label_pt, label_txt]

[fx, fx_p, fx_t] = fextInfo(fext, ux, uz)
[fy, fy_p, fy_t] = fextInfo(fext, uy, uy)
[fz, fz_p, fz_t] = fextInfo(fext, uz, uz)
# ---------- end fext_and_fext ----------
swatch_2 = ColourSwatch(SwatchColor=RGB(0, 255, 255))

# ---- group: Mext
coordonate_system = ValueList({"global": 0, "material": 1}, selected="material")
scale_4 = Panel("3")
offset_label = Panel("0.4")
cluster_2 = Cluster_3(
    mframe=sections,
    mr=mext,
    coordinate_system=coordonate_system,
    scale=scale_4,
    offset=offset_label,
    col=ColourSwatch(SwatchColor=RGB(0, 255, 255)))

# ---- group: Fr & Mr
swatch_3 = ColourSwatch(SwatchColor=RGB(240, 239, 0))
coordonate_system_2 = ValueList({"global": 0, "material": 1}, selected="global")
scale_5 = Panel("3")
offset_label_2 = Panel("0.4")
cluster_3 = Cluster_4(mframe=sections, mr=fr, coordinate_system=coordonate_system_2, scale=scale_5, offset=offset_label_2, col=swatch_3)
cluster_4 = Cluster_3(mframe=sections, mr=mr, coordinate_system=coordonate_system_2, scale=scale_5, offset=offset_label_2, col=swatch_3)

# ---- group: Sweep
scale_6 = Panel("1")
colors_2 = Colour([RGB(255, 0, 0), RGB(255, 255, 255)])
sections_5 = Plane(sections)
beam_preview_3 = BeamPreview(colors=colors_2, section=section_xy_2, mframe=sections_5)
frames_2 = Frames(L=sections_5, scale=expr("x/4", scale_6), W=1)
end_frames_2 = EndFrames(L=sections_5, scale=scale_6, W=3)

# ---- group: Fext and fext Visualisation / Fext
vdisex_2 = VectorDisplayEx(Point=fext_and_fext.pt, Vector=fext_and_fext.Fx, Colour=swatch_2, Width=2)
vdisex_3 = VectorDisplayEx(Point=fext_and_fext.pt, Vector=fext_and_fext.Fy, Colour=swatch_2, Width=2)
vdisex_4 = VectorDisplayEx(Point=fext_and_fext.pt, Vector=fext_and_fext.Fz, Colour=swatch_2, Width=2)

# ---- group: Fext and fext Visualisation / fext
preview_9 = CustomPreview(Geometry=[fext_and_fext.fx, fext_and_fext.fy, fext_and_fext.fz], Shader=swatch_2)
tag = TextTag(
    Location=[fext_and_fext.fx_p, fext_and_fext.fy_p, fext_and_fext.fz_p],
    Text=[fext_and_fext.fx_t, fext_and_fext.fy_t, fext_and_fext.fz_t],
    Colour=swatch_2)

# ---- group: Fext and fext Visualisation / Fext Labels
python_13 = PythonScript(pt=fext_and_fext.pt, v=fext_and_fext.Fx, scale=fext_and_fext.scale, offset=0.3)  # -> out, pt, label; inputs pt: list of Point3d, v: list of Vector3d
# ---------- python_13: Python ----------
import rhinoscriptsyntax as rs
import Rhino.Geometry as rg

label_offset = offset
epsilon = 1e-2
n = len(pt)

label = []

for i in range(n):
    l = v[i].Length
    if l > epsilon:
        label.append(str(round(l/scale,2) + " N"))
        u = v[i]/l
        pt[i] += (l + label_offset) * u
    else:
        label.append("")
# ---------- end python_13 ----------
python_14 = PythonScript(pt=fext_and_fext.pt, v=fext_and_fext.Fy, scale=fext_and_fext.scale, offset=0.3)  # -> out, pt, label; inputs pt: list of Point3d, v: list of Vector3d
# ---------- python_14: Python ----------
import rhinoscriptsyntax as rs
import Rhino.Geometry as rg

label_offset = offset
epsilon = 1e-2
n = len(pt)

label = []

for i in range(n):
    l = v[i].Length
    if l > epsilon:
        label.append(str(round(l/scale,2)) + " N")
        u = v[i]/l
        pt[i] += (l + label_offset) * u
    else:
        label.append("")
# ---------- end python_14 ----------
python_15 = PythonScript(pt=fext_and_fext.pt, v=fext_and_fext.Fz, scale=fext_and_fext.scale, offset=0.3)  # -> out, pt, label; inputs pt: list of Point3d, v: list of Vector3d; same code as python_14
tag_2 = TextTag(Location=python_13.pt, Text=python_13.label, Colour=swatch_2)
tag_3 = TextTag(Location=python_14.pt, Text=python_14.label, Colour=swatch_2)
tag_4 = TextTag(Location=python_15.pt, Text=python_15.label, Colour=swatch_2)

# ---- group: Display BRelax Results / Rendu des efforts
brep = Brep(rendu.geom)
bnd = Bounds(Numbers=filter)

# ----
python_16 = PythonScript(I=bnd)  # -> S, E
# ---------- python_16: Python ----------
if I[0] < 0: S = I[0] * 1.01
else: S = I[0]*0.99

if I[1]<0 : E = I[1]*0.99
else: E = I[1]*1.01
# ---------- end python_16 ----------

# ---- group: Display BRelax Results / Rendu des efforts (continued)
gradient = Gradient(
    LowerLimit=python_16.S,
    UpperLimit=python_16.E,
    Parameter=filter,
    stops=[0: RGB(18, 16, 20), 0: RGB(219, 90, 150), 0: RGB(0, 128, 0), 0.501: RGB(255, 255, 0), 1: RGB(255, 0, 0)])
min = Panel(python_16.S)
max = Panel(python_16.E)
preview_10 = CustomPreview(Geometry=brep, Shader=gradient)

# ==== cluster BeamSetup
N = ClusterInput()
section_b1 = ClusterInput()
section_b2 = ClusterInput()
initial_a = ClusterInput()
initial_ouverture = ClusterInput()
initial_twist = ClusterInput()
initial_twistmodulo = ClusterInput()
intial_symetric = ClusterInput()
repos_epsilon = ClusterInput()
repos_theta = ClusterInput()
initial_twistmodulo_2 = Number(initial_twistmodulo)
initial_ouverture_2 = Number(initial_ouverture)
intial_symetric_2 = Integer(intial_symetric)
repos_epsilon_2 = Number(repos_epsilon)
repos_theta_2 = Number(repos_theta)
initial_twist_2 = Number(initial_twist)
section_b1_2 = Number(section_b1)
section_b2_2 = Number(section_b2)
initial_a_2 = Number(initial_a)
N_2 = Number(N)

dom = ConstructDomain(DomainStart=expr("-x/2", section_b2_2), DomainEnd=expr("x/2", section_b2_2))
dom_2 = ConstructDomain(DomainStart=expr("-x/2", section_b1_2), DomainEnd=expr("x/2", section_b1_2))
rectangle = Rectangle(Plane=PlaneXY(0, 0, 0), XSize=dom_2, YSize=dom, Radius=0)  # -> Section_XY, Length
explode = Explode(Curve=rectangle.Section_XY, Recursive=True)  # -> simplify(Segments), Vertices

cluster = Cluster(X=initial_a_2, Z=0)  # -> pt_6, pt_4, pt_5

lng = ListLength(List=explode.Segments)
col = Colour([RGB(0, 0, 255), RGB(255, 255, 255)])
repeat = RepeatData(Data=col, Length=lng)

# ---- group: CONFIG : START / OUVERTURE
angle = Number(initial_ouverture_2)
pt = Point(cluster.pt_6)
pt_2 = Point(cluster.pt_5)
pl = ConstructPlane(Origin=pt, XAxis=expr("{0,0,1}", Vector(78.26149335, 0, 0)), YAxis=expr("{0,-1,0}", Vector(0, 1, 0)))
pl_2 = ConstructPlane(Origin=pt_2, XAxis=expr("{0,0,1}", Vector(78.26149335, 0, 0)), YAxis=expr("{0,-1,0}", Vector(0, 1, 0)))
deplane = DeconstructPlane(Plane=pl)  # -> Origin, XAxis, YAxis, ZAxis
deplane_2 = DeconstructPlane(Plane=pl_2)  # -> Origin, XAxis, YAxis, ZAxis
rot3d = Rotate3D(Geometry=pl_2, Angle=expr("-x", degrees(angle)), Center=deplane_2.Origin, Axis=deplane_2.YAxis)  # -> Geometry, Transform
rot3d_2 = Rotate3D(Geometry=pl, Angle=degrees(angle), Center=deplane.Origin, Axis=deplane.YAxis)  # -> Geometry, Transform

# ---- group: CONFIG : START / TWIST
angle_2 = Number(initial_twist_2)
pln = Plane(rot3d.Geometry)
pln_2 = Plane(rot3d_2.Geometry)
deplane_3 = DeconstructPlane(Plane=pln_2)  # -> Origin, XAxis, YAxis, ZAxis
deplane_4 = DeconstructPlane(Plane=pln)  # -> Origin, XAxis, YAxis, ZAxis
multiplication = Multiplication(A=angle_2, B=intial_symetric_2)
rot3d_3 = Rotate3D(Geometry=pln, Angle=expr("-x", degrees(multiplication)), Center=deplane_4.Origin, Axis=expr("{0,0,1}", Vector(0, 0, 1)))  # -> Geometry, Transform
rot3d_4 = Rotate3D(Geometry=pln_2, Angle=degrees(angle_2), Center=deplane_3.Origin, Axis=expr("{0,0,1}", Vector(0, 0, 1)))  # -> Geometry, Transform

# ---- group: CONFIG : START
pln_3 = Plane(rot3d_4.Geometry)
pln_4 = Plane(rot3d_3.Geometry)
deplane_5 = DeconstructPlane(Plane=pln_3)  # -> Origin, XAxis, YAxis, ZAxis
deplane_6 = DeconstructPlane(Plane=pln_4)  # -> Origin, XAxis, YAxis, ZAxis
intcrv_t = InterpolateT(
    Vertices=[deplane_5.Origin, deplane_6.Origin],
    Degree=3,
    TangentStart=deplane_5.ZAxis,
    TangentEnd=deplane_6.ZAxis,
    KnotStyle=0)  # -> Curve, Length, Domain

divide = DivideCurve(Curve=intcrv_t.Curve, Count=N_2, Kinks=False)  # -> Points, Tangents, Parameters
beam_geo = BeamGeometry(StartSection=pln_3, EndSection=pln_4, CenterlinePositions=divide.Points, TwistModulo=initial_twistmodulo_2)  # -> PT, sections, twist_closure, t, l, ll, kb
planes_i = Plane(beam_geo.sections)

# ---- group: CONFIG : REST
pline = PolyLine(Vertices=divide.Points, Closed=False)
explode_2 = Explode(Curve=pline, Recursive=True)  # -> Segments, Vertices
len = Length(Curve=pline)
len_2 = Length(Curve=explode_2.Segments)
multiplication_2 = Multiplication(A=len_2, B=repos_epsilon_2)
ma = MassAddition(Input=multiplication_2)  # -> Result, PartialResults
pt_3 = ConstructPoint(XCoordinate=expr("-x/2", len), YCoordinate=0, ZCoordinate=0)
X = UnitX(Factor=ma.PartialResults)
move = Move(Geometry=pt_3, Motion=X)  # -> Geometry, Transform
pline_2 = PolyLine(Vertices=flatten([pt_3, move.Geometry]), Closed=False)  # -> reparameterize(Polyline)

alpha = Slider(0, range=-90..90)
unit = UnitVector(Vector=X)
pframe = PerpFrame(Curve=pline_2, Parameter=0)
pt_plane = ParallelTransportAPlane(Plane=pframe, Points=move.Geometry, Vectors=unit, Alpha=expr("Rad(x)", alpha), Theta=expr("Rad(x)", repos_theta_2))
planes_0 = Plane(pt_plane)

# ---- group: 3D
orient = Orient(Geometry=graft(explode.Segments), Source=PlaneXY(0, 0, 0), Target=planes_0)  # -> Geometry, Transform
geo = Geometry(orient.Geometry)
swp1 = Sweep1(Rail=pline_2, Sections=simplify(geo), Miter=1)  # -> simplify(Brep)
preview = CustomPreview(Geometry=swp1, Shader=simplify(graft(repeat)))

orient_2 = Orient(Geometry=graft(explode.Segments), Source=PlaneXY(0, 0, 0), Target=planes_i)  # -> Geometry, Transform
geo_2 = Geometry(orient_2.Geometry)
swp1_2 = Sweep1(Rail=intcrv_t.Curve, Sections=simplify(geo_2), Miter=1)  # -> simplify(Brep)
preview_2 = CustomPreview(Geometry=swp1_2, Shader=simplify(graft(repeat)))

# ----
deplane_7 = DeconstructPlane(Plane=planes_i)  # -> Origin, XAxis, YAxis, ZAxis
pline_3 = PolyLine(Vertices=deplane_7.Origin, Closed=False)
planes_i_2 = ClusterOutput(planes_i)
section_xy = ClusterOutput(rectangle.Section_XY)
planes_0_2 = ClusterOutput(planes_0)

# ==== cluster BeamPreview
section = ClusterInput()
colors = ClusterInput()
mframe = ClusterInput()
python = PythonScript(section=section, mframe=mframe)  # -> out, brep, rails, shapes; inputs section: list of Curve, mframe: list of Plane
# ---------- python: Python ----------
import rhinoscriptsyntax as rs
import Rhino as rh

n = len(mframe)
pts = []

# create centerline
for i in range(n):
    pts.append(mframe[i].Origin)
centerline = rh.Geometry.Curve.CreateControlPointCurve(pts)

# split centerline
t = []
for pt in pts:
    t.append(rs.CurveClosestPoint(centerline, pt))
rails = centerline.Split(t)

brep = []
shapes = []
for i in range(n-1):
    shape1 = section[i].Duplicate()
    shape1.Transform(rh.Geometry.Transform.PlaneToPlane(rh.Geometry.Plane.WorldXY, mframe[i]))
    shape2 = section[i].Duplicate()
    shape2.Transform(rh.Geometry.Transform.PlaneToPlane(rh.Geometry.Plane.WorldXY, mframe[i+1]))
    rail = rails[i]
    shapes.append(shape1)
    shapes.append(shape2)
    
    brep.append(rh.Geometry.Brep.JoinBreps(rh.Geometry.Brep.CreateFromSweep(rail, [shape1,shape2], True, 1e-6), 1e-6)[0])
    


print t
# ---------- end python ----------
preview = CustomPreview(Geometry=python.brep, Shader=simplify(graft(ColourSwatch(SwatchColor=RGB(87, 128, 255)))))

# ==== cluster EndFrames
L = ClusterInput()
scale = ClusterInput()
W = ClusterInput()
item = ListItem(List=L, Index=[0, -1], Wrap=True)
deplane = DeconstructPlane(Plane=item)  # -> Origin, XAxis, YAxis, ZAxis
scale_2 = Number(scale)
W_2 = Integer(W)
G = Point(deplane.Origin)
d2 = Vector(deplane.YAxis)
d1 = Vector(deplane.XAxis)
d3 = Vector(deplane.ZAxis)
multiplication = Multiplication(A=d3, B=scale_2)
multiplication_2 = Multiplication(A=d1, B=scale_2)
multiplication_3 = Multiplication(A=d2, B=scale_2)
vdisex = VectorDisplayEx(Point=G, Vector=multiplication, Colour=RGB(0, 0, 255), Width=W_2)
vdisex_2 = VectorDisplayEx(Point=G, Vector=multiplication_2, Colour=RGB(255, 0, 0), Width=W_2)
vdisex_3 = VectorDisplayEx(Point=G, Vector=multiplication_3, Colour=RGB(0, 255, 0), Width=W_2)

# ==== cluster Frames
L = ClusterInput()
scale = ClusterInput()
W = ClusterInput()
cull_i = CullIndex(List=L, Indices=[0, -1], Wrap=True)
deplane = DeconstructPlane(Plane=cull_i)  # -> Origin, XAxis, YAxis, ZAxis
scale_2 = Number(scale)
W_2 = Integer(W)
G = Point(deplane.Origin)
d2 = Vector(deplane.YAxis)
d1 = Vector(deplane.XAxis)
d3 = Vector(deplane.ZAxis)
multiplication = Multiplication(A=d3, B=scale_2)
multiplication_2 = Multiplication(A=d1, B=scale_2)
multiplication_3 = Multiplication(A=d2, B=scale_2)
vdisex = VectorDisplayEx(Point=G, Vector=multiplication, Colour=RGB(0, 0, 255), Width=W_2)
vdisex_2 = VectorDisplayEx(Point=G, Vector=multiplication_2, Colour=RGB(255, 0, 0), Width=W_2)
vdisex_3 = VectorDisplayEx(Point=G, Vector=multiplication_3, Colour=RGB(0, 255, 0), Width=W_2)

# ==== cluster Cluster_2
pln = ClusterInput()

pln_2 = Plane(pln)
item = ListItem(List=pln_2, Index=0, Wrap=True)
vec2pt = Vector2Pt(PointA=item, PointB=Point(0, 0, 0), Unitize=False)  # -> Vector, Length
move = Move(Geometry=pln_2, Motion=vec2pt.Vector)  # -> Geometry, Transform

G = ClusterOutput(move.Geometry)

# ==== cluster VectorDisplay
frame = ClusterInput()
display_vectors = ClusterInput()
autoscale_vectors = ClusterInput()
color = ClusterInput()
weight = ClusterInput()
scale = ClusterInput()
autoscale = ClusterInput()
frame_2 = Plane(frame)
display_vectors_2 = Vector(display_vectors)
autoscale_vectors_2 = Vector(autoscale_vectors)
color_2 = Colour(color)
weight_2 = Number(weight)
scale_2 = Number(scale)
autoscale_2 = Number(autoscale)
deplane = DeconstructPlane(Plane=frame_2)  # -> Origin, XAxis, YAxis, ZAxis
vlen = VectorLength(Vector=display_vectors_2)
vlen_2 = VectorLength(Vector=[autoscale_vectors_2, display_vectors_2])
bnd = Bounds(Numbers=expr("abs(x)", flatten(vlen)))
bnd_2 = Bounds(Numbers=expr("abs(x)", flatten(vlen_2)))
dedomain = DeconstructDomain(Domain=bnd)  # -> Start, expr("5/x", End)
dedomain_2 = DeconstructDomain(Domain=bnd_2)  # -> Start, expr("5/x", End)
filter = StreamFilter(Gate=autoscale_2, Stream0=scale_2, Stream1=dedomain.End, Stream2=dedomain_2.End)
multiplication = Multiplication(A=display_vectors_2, B=filter)
vdisex = VectorDisplayEx(Point=deplane.Origin, Vector=multiplication, Colour=color_2, Width=weight_2)

# ==== cluster Cluster_3
mframe = ClusterInput()
coordinate_system = ClusterInput()  # global (0) or material (1)
scale = ClusterInput()
mr = ClusterInput()
col = ClusterInput()
offset = ClusterInput()
mframe_2 = Plane(mframe)
scale_2 = Number(scale)
mr_2 = Vector(mr)
cs = Text(coordinate_system)
col_2 = Colour(col)
offset_2 = Number(offset)
Y = UnitY(Factor=1)
Z = UnitZ(Factor=1)
deplane = DeconstructPlane(Plane=mframe_2)  # -> Origin, XAxis, YAxis, ZAxis
X = UnitX(Factor=1)
lng = ListLength(List=mframe_2)
repeat = RepeatData(Data=X, Length=lng)
repeat_2 = RepeatData(Data=Y, Length=lng)
repeat_3 = RepeatData(Data=Z, Length=lng)
filter = StreamFilter(Gate=cs, Stream0=repeat, Stream1=deplane.XAxis)
filter_2 = StreamFilter(Gate=cs, Stream0=repeat_2, Stream1=deplane.YAxis)
filter_3 = StreamFilter(Gate=cs, Stream0=repeat_3, Stream1=deplane.ZAxis)
display_fr = PythonScript(mframe=mframe_2, Fr=mr_2, dir=filter, scale=scale_2, offset=offset_2)  # -> out, pt, vec, label_pt, label_txt; inputs mframe: list of Plane, Fr: list of Vector3d, dir: list of Vector3d
# ---------- display_fr: Python ----------
import rhinoscriptsyntax as rs
import Rhino.Geometry as rg

epsilon = 1e-2
n = len(mframe)

# determine le max global
max = 0
for v in Fr:
    if v.Length > max: max = v.Length

if max > 0 :
    scale = scale / max
    
    pt = []
    vec = []
    label_txt = []
    label_pt = []
    
    for i in range(n):
        v = scale * (Fr[i] * dir[i]) * dir[i]
        l = v.Length
        if l > epsilon:
            pt.append(mframe[i].Origin)
            vec.append(v)
            label_txt.append(str(round(Fr[i] * dir[i],2))+" N")
            label_pt.append(pt[-1] + (l+offset)*v/l)
# ---------- end display_fr ----------
display_fr_2 = PythonScript(mframe=mframe_2, Fr=mr_2, dir=filter_3, scale=scale_2, offset=offset_2)  # -> out, pt, vec, label_pt, label_txt; inputs mframe: list of Plane, Fr: list of Vector3d, dir: list of Vector3d; same code as display_fr
display_fr_3 = PythonScript(mframe=mframe_2, Fr=mr_2, dir=filter_2, scale=scale_2, offset=offset_2)  # -> out, pt, vec, label_pt, label_txt; inputs mframe: list of Plane, Fr: list of Vector3d, dir: list of Vector3d; same code as display_fr
concat = Concatenate(FragmentA=display_fr.label_txt, FragmentB="m")
concat_2 = Concatenate(FragmentA=display_fr_2.label_txt, FragmentB="m")
concat_3 = Concatenate(FragmentA=display_fr_3.label_txt, FragmentB="m")
vdisex = VectorDisplayEx(Point=display_fr.pt, Vector=expr("x*0.9", display_fr.vec), Colour=col_2, Width=2)
vdisex_2 = VectorDisplayEx(Point=display_fr_2.pt, Vector=expr("x*0.9", display_fr_2.vec), Colour=col_2, Width=2)
vdisex_3 = VectorDisplayEx(Point=display_fr.pt, Vector=display_fr.vec, Colour=col_2, Width=2)
vdisex_4 = VectorDisplayEx(Point=display_fr_2.pt, Vector=display_fr_2.vec, Colour=col_2, Width=2)
tag = TextTag(Location=display_fr.label_pt, Text=concat, Colour=col_2)
tag_2 = TextTag(Location=display_fr_2.label_pt, Text=concat_2, Colour=col_2)
vdisex_5 = VectorDisplayEx(Point=display_fr_3.pt, Vector=expr("x*0.9", display_fr_3.vec), Colour=col_2, Width=2)
vdisex_6 = VectorDisplayEx(Point=display_fr_3.pt, Vector=display_fr_3.vec, Colour=col_2, Width=2)
tag_3 = TextTag(Location=display_fr_3.label_pt, Text=concat_3, Colour=col_2)

# ==== cluster Cluster_4
mframe = ClusterInput()
coordinate_system = ClusterInput()  # global (0) or material (1)
scale = ClusterInput()
mr = ClusterInput()
col = ClusterInput()
offset = ClusterInput()
mframe_2 = Plane(mframe)
scale_2 = Number(scale)
mr_2 = Vector(mr)
cs = Text(coordinate_system)
col_2 = Colour(col)
offset_2 = Number(offset)
Y = UnitY(Factor=1)
Z = UnitZ(Factor=1)
deplane = DeconstructPlane(Plane=mframe_2)  # -> Origin, XAxis, YAxis, ZAxis
X = UnitX(Factor=1)
lng = ListLength(List=mframe_2)
repeat = RepeatData(Data=X, Length=lng)
repeat_2 = RepeatData(Data=Y, Length=lng)
repeat_3 = RepeatData(Data=Z, Length=lng)
filter = StreamFilter(Gate=cs, Stream0=repeat, Stream1=deplane.XAxis)
filter_2 = StreamFilter(Gate=cs, Stream0=repeat_2, Stream1=deplane.YAxis)
filter_3 = StreamFilter(Gate=cs, Stream0=repeat_3, Stream1=deplane.ZAxis)
display_fr = PythonScript(mframe=mframe_2, Fr=mr_2, dir=filter, scale=scale_2, offset=offset_2)  # -> out, pt, vec, label_pt, label_txt; inputs mframe: list of Plane, Fr: list of Vector3d, dir: list of Vector3d
# ---------- display_fr: Python ----------
import rhinoscriptsyntax as rs
import Rhino.Geometry as rg

epsilon = 1e-2
n = len(mframe)

# determine le max global
max = 0
for v in Fr:
    if v.Length > max: max = v.Length
    
scale = scale / max

pt = []
vec = []
label_txt = []
label_pt = []

for i in range(n):
    v = scale * (Fr[i] * dir[i]) * dir[i]
    l = v.Length
    if l > epsilon:
        pt.append(mframe[i].Origin)
        vec.append(v)
        label_txt.append(str(round(Fr[i] * dir[i],2))+" N")
        label_pt.append(pt[-1] + (l+offset)*v/l)
# ---------- end display_fr ----------
display_fr_2 = PythonScript(mframe=mframe_2, Fr=mr_2, dir=filter_2, scale=scale_2, offset=offset_2)  # -> out, pt, vec, label_pt, label_txt; inputs mframe: list of Plane, Fr: list of Vector3d, dir: list of Vector3d; same code as display_fr
display_fr_3 = PythonScript(mframe=mframe_2, Fr=mr_2, dir=filter_3, scale=scale_2, offset=offset_2)  # -> out, pt, vec, label_pt, label_txt; inputs mframe: list of Plane, Fr: list of Vector3d, dir: list of Vector3d; same code as display_fr
vdisex = VectorDisplayEx(Point=display_fr.pt, Vector=display_fr.vec, Colour=col_2, Width=2)
tag = TextTag(Location=display_fr.label_pt, Text=display_fr.label_txt, Colour=col_2)
vdisex_2 = VectorDisplayEx(Point=display_fr_2.pt, Vector=display_fr_2.vec, Colour=col_2, Width=2)
vdisex_3 = VectorDisplayEx(Point=display_fr_3.pt, Vector=display_fr_3.vec, Colour=col_2, Width=2)
tag_2 = TextTag(Location=display_fr_2.label_pt, Text=display_fr_2.label_txt, Colour=col_2)
tag_3 = TextTag(Location=display_fr_3.label_pt, Text=display_fr_3.label_txt, Colour=col_2)

# ==== cluster Cluster
X = ClusterInput()
Z = ClusterInput()
pt = ConstructPoint(XCoordinate=expr("x/2", X), YCoordinate=0, ZCoordinate=0)
pt_2 = ConstructPoint(XCoordinate=expr("-x/2", X), YCoordinate=0, ZCoordinate=0)
pt_3 = ConstructPoint(XCoordinate=0, YCoordinate=0, ZCoordinate=Z)
pt_4 = ClusterOutput(pt_3)
pt_5 = ClusterOutput(pt)
pt_6 = ClusterOutput(pt_2)
