# Grasshopper definition 20160320_double_beam_with link.gh (Grasshopper 0.9.76)
# plug-ins: Python Interpreter, TMarsupilami

N = Slider(8, range=0..100)

elongation = Slider(1, range=0.5..1.5)
theta_0 = Slider(0, range=-20..20)

shift_x_y = BooleanToggle(False)
b1 = Slider(0.2, range=0.01..0.5)
b2 = Slider(0.4, range=0..0.5)

list = ValueList({"symetric": 1, "antisymetric": -1}, selected="antisymetric")
a = Slider(10, range=5..20)
ouverture = Slider(60, range=0..90)
twist = Slider(0, range=-45..45)
twistmodulo = Slider(0, range=-2..2)

f1 = Slider(1, range=1..4)
f2 = Slider(1, range=1..4)
t = Slider(0, range=0..1)

# ----
# SECTIONS DEF
sections = PythonScript(shift=shift_x_y, b1=b1, b2=b2, f1=f1, f2=f2)  # -> P, R1, R2; inputs shift: Boolean
# ---------- sections: Python ----------
import Rhino.Geometry as rg

if shift:
    lx = b2
    ly = b1
    fx = f2
    fy = f1
    P = rg.Plane.WorldXY
else:
    lx = b1
    ly = b2
    fx = f1
    fy = f2
    P = rg.Plane.WorldXY

P1 = rg.Plane.WorldXY
P1.Origin = P1.Origin - (lx/2)*P1.XAxis - (ly/2)*P1.YAxis
R1 = rg.Rectangle3d(P1, lx, ly)

P2 = rg.Plane.WorldXY
P2.Origin = P2.Origin - (lx/(2*fx))*P2.XAxis - (ly/(2*fy))*P2.YAxis
 
R2 = rg.Rectangle3d(P2, lx/fx, ly/fy)


print lx
print ly
# ---------- end sections ----------
fdis = FrameDisplay(Frame=sections.P, ScaleFactor=2, LineWidth=[0, 3, 3], Color=[RGB(0, 0, 255), RGB(255, 0, 0), RGB(0, 255, 0)])
crv = Curve([sections.R1, sections.R2])

# ----
# INITIAL CONFIG
start_end_frames = StartEndFrames(initial_a=a, initial_ouverture=ouverture, initial_twist=twist, intial_symetric=list)  # -> fs, fe

_2ne = Integer(expr("2*x", N))

multiplication = Multiplication(A=_2ne, B=t)
int = Integer(multiplication)
c_script = CSharpScript(
    N=_2ne,
    n=int,
    R1=sections.R1,
    R2=sections.R2,
    Reference=["C:\Users\Véronique\Lionel\Github\TMarsupilami2\src\TMarsupilami.Gh\bin\TMarsupilami.MathLib.dll", "C:\Users\Véronique\Lionel\Github\TMarsupilami2\src\TMarsupilami.Gh\bin\TMarsupilami.Gh.dll"])  # -> out, bx, by; inputs N: Int32, n: Int32, R1: Rectangle3d, R2: Rectangle3d
# ---------- c_script: C# ----------
    double[] b1, b2;
    b1 = new double[N];
    b2 = new double[N];

    if (n < 1)
    {
      for (int i = 0; i < N; i++)
      {
        b1[i] = R2.Width;
        b2[i] = R2.Height;
      }
    }
    else if (n > N+1)
    {
      for (int i = 0; i < N+1; i++)
      {
        b1[i] = R1.Width;
        b2[i] = R1.Height;
      }
    }
    else
    {
      for (int i = 0; i < n; i++)
      {
        b1[i] = R1.Width;
        b2[i] = R1.Height;
      }
      for (int i = n; i < N; i++)
      {
        b1[i] = R2.Width;
        b2[i] = R2.Height;
      }
    }



    // output
    bx = b1;
    by = b2;
# ---------- end c_script ----------

geom = DefineBeamGeometrySingle(StartFrame=start_end_frames.fs, EndFrame=start_end_frames.fe, EdgeCount=_2ne, TwistModulo=twistmodulo)  # -> BeamCenterline, Frames

# ----
# REST CONFIG
len = Length(Curve=geom.BeamCenterline)
multiplication_2 = Multiplication(A=elongation, B=len)
cluster = Cluster_2(initial_a=multiplication_2)  # -> fs, fe

geom_2 = DefineBeamGeometrySingle(StartFrame=cluster.fs, EndFrame=cluster.fe, EdgeCount=_2ne, TwistModulo=0)  # -> BeamCenterline, Frames
rz = ZRotateAFrame(FrameS=geom_2.Frames, ZTwistAngleS=theta_0)

mframe = Frame(rz)
mframe_2 = Frame(geom.Frames)

# ---- group: Beam A
sections_0 = Plane(rz)
sections_i = Plane(mframe_2)
section_b2 = Number(c_script.by)
section_b1 = Number(c_script.bx)

# ----
number_slider = Slider(20, range=-90..90)
Z = UnitZ(Factor=0.2)
list_2 = ValueList({"FREE": 0, "PIN": 1, "CLAMPED": 2}, selected="CLAMPED")
list_3 = ValueList({"FREE": 0, "PIN": 1, "CLAMPED": 2}, selected="PIN")
list_4 = ValueList({"FREE": 0, "PIN": 1, "CLAMPED": 2}, selected="CLAMPED")
list_5 = ValueList({"FREE": 0, "PIN": 1, "CLAMPED": 2}, selected="PIN")
col = Colour([RGB(255, 0, 0), RGB(0, 255, 0), RGB(0, 0, 255)])
panel = Panel("1e14")

cull = CullPattern(List=section_b1, CullPattern=[True, False])
cull_2 = CullPattern(List=section_b2, CullPattern=[True, False])
cull_3 = CullPattern(List=sections_0, CullPattern=[True, False])
cull_4 = CullPattern(List=sections_i, CullPattern=[True, False])
sections_i_2 = Plane(cull_4)
section_b2_2 = Number(cull_2)
section_b1_2 = Number(cull)

rotate = Rotate(Geometry=cull_3, Angle=degrees(number_slider), Plane=PlaneXY(0, 0, 0))  # -> Geometry, Transform
rotate_2 = Rotate(Geometry=sections_i_2, Angle=degrees(number_slider), Plane=PlaneXY(0, 0, 0))  # -> Geometry, Transform
scale = Scale(Geometry=cull_3, Center=Point(0, 0, 0), Factor="1.05")  # -> Geometry, Transform
move = Move(Geometry=rotate.Geometry, Motion=Z)  # -> Geometry, Transform

mframe_3 = Frame(move.Geometry)
intcrv = Interpolate(Vertices=mframe_3, Degree=3, Periodic=False, KnotStyle=1)  # -> Curve, Length, Domain
crv_2 = Curve(intcrv.Curve)

sections_0_2 = Plane(scale.Geometry)

mframe_4 = Frame(sections_0_2)
intcrv_2 = Interpolate(Vertices=mframe_4, Degree=3, Periodic=False, KnotStyle=1)  # -> Curve, Length, Domain
crv_3 = Curve(intcrv_2.Curve)

# ---- group: Display Frames
cull_i = CullIndex(List=mframe_3, Indices=[0, -1], Wrap=True)
item = ListItem(List=mframe_3, Index=[0, -1], Wrap=True)
fdis_2 = FrameDisplay(Frame=cull_i, ScaleFactor=1, LineWidth=[2, 1, 1], Color=[RGB(255, 0, 0), RGB(0, 255, 0), RGB(0, 0, 255)])
fdis_3 = FrameDisplay(Frame=item, ScaleFactor=4, LineWidth=3, Color=[RGB(255, 0, 0), RGB(0, 255, 0), RGB(0, 0, 255)])

# ---- group: Display Brep
c_script_2 = CSharpScript(
    centerline=crv_2,
    F=mframe_3,
    n=int,
    P=sections.P,
    R1=sections.R1,
    R2=sections.R2,
    Reference=["C:\USERS\VÉRONIQUE\LIONEL\GITHUB\TMARSUPILAMI2\SRC\TMARSUPILAMI.GH\BIN\TMarsupilami.MathLib.dll", "C:\USERS\VÉRONIQUE\LIONEL\GITHUB\TMARSUPILAMI2\SRC\TMARSUPILAMI.GH\BIN\TMarsupilami.Gh.dll"])  # -> out, C, S, B; inputs centerline: Curve, F: list, n: Int32, P: Plane, R1: Rectangle3d, R2: Rectangle3d
# ---------- c_script_2: C# ----------
    MFrame[ ] f1, f2;
    Curve c1, c2;
    Curve[] s1, s2;
    Brep b1, b2;

    var sweep = new Rhino.Geometry.SweepOneRail();
    sweep.MiterType = 0;
    sweep.GlobalShapeBlending = false;

    var sweep2 = new Rhino.Geometry.SweepTwoRail();

    if (n < 1)
    {
      f1 = new MFrame[0];
      f2 = new MFrame[F.Count];
      for (int i = 0; i < F.Count; i++)
      {
        f2[i] = (MFrame) F[i];
      }
      c1 = null;
      c2 = centerline;
    }
    else if (n > F.Count)
    {
      f2 = new MFrame[0];
      f1 = new MFrame[F.Count];
      for (int i = 0; i < F.Count; i++)
      {
        f1[i] = (MFrame) F[i];
      }
      c1 = centerline;
      c2 = null;
    }
    else
    {
      f1 = new MFrame[n];
      for (int i = 0; i < f1.Length; i++)
      {
        f1[i] = (MFrame) F[i];
      }
      f2 = new MFrame[F.Count - n + 1];
      for (int i = 0; i < f2.Length; i++)
      {
        f2[i] = (MFrame) F[n - 1 + i];
      }

      // changing point
      double param;
      var point = f1[n - 1].Origin.Cast();
      centerline.ClosestPoint(point, out param);
      var subCurves = centerline.Split(param);
      c1 = subCurves[0];
      c2 = subCurves[1];
    }

    var c = new List<Curve>();
    var s = new List<Curve>();
    var f = new List<MFrame>();
    var b = new List<Brep>();

    // Sweep over C1
    if (c1 != null)
    {
      var pts = new Point3d[f1.Length];
      s1 = new Rhino.Geometry.Curve[f1.Length];
      for (int i = 0; i < f1.Length; i++)
      {
        var xform = Transform.PlaneToPlane(P, f1[i].Cast());
        var polyline = R1.ToPolyline();
        polyline.Transform(xform);
        s1[i] = new Rhino.Geometry.PolylineCurve(polyline);
        pts[i] = polyline[0];
      }
      var rail_ext = Rhino.Geometry.Curve.CreateInterpolatedCurve(pts, 3);
      var rail_int = c1;
      b1 = sweep2.PerformSweep(rail_int, rail_ext, s1)[0];

      var cap_1 = Rhino.Geometry.Brep.CreatePlanarBreps(s1[0])[0];
      var cap_2 = Rhino.Geometry.Brep.CreatePlanarBreps(s1[f1.Length - 1])[0];
      b1 = Brep.JoinBreps(new Brep[3]{cap_1, b1, cap_2}, 1e-9)[0];

      c.Add(c1);
      s.AddRange(s1);
      b.Add(b1);
    }
    if (c2 != null)
    {
      var pts = new Point3d[f2.Length];
      s2 = new Rhino.Geometry.Curve[f2.Length];
      for (int i = 0; i < f2.Length; i++)
      {
        var xform = Transform.PlaneToPlane(P, f2[i].Cast());
        var polyline = R2.ToPolyline();
        polyline.Transform(xform);
        s2[i] = new Rhino.Geometry.PolylineCurve(polyline);
        pts[i] = polyline[0];
      }
      var rail_ext = Rhino.Geometry.Curve.CreateInterpolatedCurve(pts, 3);
      var rail_int = c2;
      b2 = sweep2.PerformSweep(rail_int, rail_ext, s2)[0];

      var cap_1 = Rhino.Geometry.Brep.CreatePlanarBreps(s2[0])[0];
      var cap_2 = Rhino.Geometry.Brep.CreatePlanarBreps(s2[f2.Length - 1])[0];
      b2 = Brep.JoinBreps(new Brep[3]{cap_1, b2, cap_2}, 1e-9)[0];

      c.Add(c2);
      s.AddRange(s2);
      b.Add(b2);
    }

    // output
    C = c;
    S = s;
    B = b;
# ---------- end c_script_2 ----------
crv_4 = Curve(c_script_2.C)
crv_5 = Curve(c_script_2.S)
brep = Brep(c_script_2.B)
preview = CustomPreview(Geometry=brep, Shader=ColourSwatch(SwatchColor=RGB(27, 255, 10)))

# ---- group: Display Frames
cull_i_2 = CullIndex(List=mframe_4, Indices=[0, -1], Wrap=True)
item_2 = ListItem(List=mframe_4, Index=[0, -1], Wrap=True)
fdis_4 = FrameDisplay(Frame=cull_i_2, ScaleFactor=1, LineWidth=[2, 1, 1], Color=[RGB(255, 0, 0), RGB(0, 255, 0), RGB(0, 0, 255)])
fdis_5 = FrameDisplay(Frame=item_2, ScaleFactor=4, LineWidth=3, Color=[RGB(255, 0, 0), RGB(0, 255, 0), RGB(0, 0, 255)])

# ---- group: Display Brep
c_script_3 = CSharpScript(
    centerline=crv_3,
    F=mframe_4,
    n=int,
    P=sections.P,
    R1=sections.R1,
    R2=sections.R2,
    Reference=["C:\USERS\VÉRONIQUE\LIONEL\GITHUB\TMARSUPILAMI2\SRC\TMARSUPILAMI.GH\BIN\TMarsupilami.MathLib.dll", "C:\USERS\VÉRONIQUE\LIONEL\GITHUB\TMARSUPILAMI2\SRC\TMARSUPILAMI.GH\BIN\TMarsupilami.Gh.dll"])  # -> out, C, S, B; inputs centerline: Curve, F: list, n: Int32, P: Plane, R1: Rectangle3d, R2: Rectangle3d; same code as c_script_2
crv_6 = Curve(c_script_3.C)
brep_2 = Brep(c_script_3.B)
crv_7 = Curve(c_script_3.S)
preview_2 = CustomPreview(Geometry=brep_2, Shader=ColourSwatch(SwatchColor=RGB(0, 255, 229)))

# ----
_4_dof_disc_skdr = _4_DOF_DISC_SKDR_Link(
    RestPosition=sections_0_2,
    InitialPosition=sections_i_2,
    SectionB1=section_b1_2,
    SectionB2=section_b2_2,
    BoundaryConditionAtStart=list_2,
    BoundaryConditionAtEnd=list_3,
    RestPosition_2=move.Geometry,
    InitialPosition_2=rotate_2.Geometry,
    SectionB1_2=section_b1_2,
    SectionB2_2=section_b2_2,
    BoundaryConditionAtStart_2=list_4,
    BoundaryConditionAtEnd_2=list_5,
    Iteration_max="500",
    Reset=Button(),
    IsBase=True)
split = SplitList(List=_4_dof_disc_skdr, Index=1)  # -> ListA, ListB
bdis = BeamInternals(Beam=split.ListB)  # -> simplify(Frames), N, N_2, MextL, FextG, MextL_2, FrG, MrL
bdis_2 = BeamInternals(Beam=split.ListA)  # -> simplify(Frames), N, N_2, MextL, FextG, MextL_2, FrG, MrL

mframe_5 = Frame(bdis.Frames)
intcrv_3 = Interpolate(Vertices=mframe_5, Degree=3, Periodic=False, KnotStyle=1)  # -> Curve, Length, Domain
crv_8 = Curve(intcrv_3.Curve)

mframe_6 = Frame(bdis_2.Frames)
intcrv_4 = Interpolate(Vertices=mframe_6, Degree=3, Periodic=False, KnotStyle=1)  # -> Curve, Length, Domain
crv_9 = Curve(intcrv_4.Curve)

# ---- group: Display Frames
cull_i_3 = CullIndex(List=mframe_5, Indices=[0, -1], Wrap=True)
item_3 = ListItem(List=mframe_5, Index=[0, -1], Wrap=True)
fdis_6 = FrameDisplay(Frame=cull_i_3, ScaleFactor=1, LineWidth=[2, 1, 1], Color=[RGB(255, 0, 0), RGB(0, 255, 0), RGB(0, 0, 255)])
fdis_7 = FrameDisplay(Frame=item_3, ScaleFactor=4, LineWidth=3, Color=[RGB(255, 0, 0), RGB(0, 255, 0), RGB(0, 0, 255)])

# ---- group: Display Brep
c_script_4 = CSharpScript(
    centerline=crv_8,
    F=mframe_5,
    n=int,
    P=sections.P,
    R1=sections.R1,
    R2=sections.R2,
    Reference=["C:\USERS\VÉRONIQUE\LIONEL\GITHUB\TMARSUPILAMI2\SRC\TMARSUPILAMI.GH\BIN\TMarsupilami.MathLib.dll", "C:\USERS\VÉRONIQUE\LIONEL\GITHUB\TMARSUPILAMI2\SRC\TMARSUPILAMI.GH\BIN\TMarsupilami.Gh.dll"])  # -> out, C, S, B; inputs centerline: Curve, F: list, n: Int32, P: Plane, R1: Rectangle3d, R2: Rectangle3d; same code as c_script_2
crv_10 = Curve(c_script_4.C)
crv_11 = Curve(c_script_4.S)
brep_3 = Brep(c_script_4.B)
preview_3 = CustomPreview(Geometry=brep_3, Shader=ColourSwatch(SwatchColor=RGB(255, 247, 10)))

# ---- group: Display Frames
cull_i_4 = CullIndex(List=mframe_6, Indices=[0, -1], Wrap=True)
item_4 = ListItem(List=mframe_6, Index=[0, -1], Wrap=True)
fdis_8 = FrameDisplay(Frame=cull_i_4, ScaleFactor=1, LineWidth=[2, 1, 1], Color=[RGB(255, 0, 0), RGB(0, 255, 0), RGB(0, 0, 255)])
fdis_9 = FrameDisplay(Frame=item_4, ScaleFactor=4, LineWidth=3, Color=[RGB(255, 0, 0), RGB(0, 255, 0), RGB(0, 0, 255)])

# ---- group: Display Brep
c_script_5 = CSharpScript(
    centerline=crv_9,
    F=mframe_6,
    n=int,
    P=sections.P,
    R1=sections.R1,
    R2=sections.R2,
    Reference=["C:\USERS\VÉRONIQUE\LIONEL\GITHUB\TMARSUPILAMI2\SRC\TMARSUPILAMI.GH\BIN\TMarsupilami.MathLib.dll", "C:\USERS\VÉRONIQUE\LIONEL\GITHUB\TMARSUPILAMI2\SRC\TMARSUPILAMI.GH\BIN\TMarsupilami.Gh.dll"])  # -> out, C, S, B; inputs centerline: Curve, F: list, n: Int32, P: Plane, R1: Rectangle3d, R2: Rectangle3d; same code as c_script_2
crv_12 = Curve(c_script_5.C)
crv_13 = Curve(c_script_5.S)
brep_4 = Brep(c_script_5.B)
preview_4 = CustomPreview(Geometry=brep_4, Shader=ColourSwatch(SwatchColor=RGB(255, 247, 10)))

# ==== cluster StartEndFrames
initial_a = ClusterInput()
initial_ouverture = ClusterInput()
initial_twist = ClusterInput()
intial_symetric = ClusterInput()
initial_ouverture_2 = Number(initial_ouverture)
intial_symetric_2 = Integer(intial_symetric)
initial_twist_2 = Number(initial_twist)
initial_a_2 = Number(initial_a)
cluster = Cluster(X=initial_a_2, Z=0)  # -> pt_6, pt_4, pt_5

# ---- group: CONFIG : START / OUVERTURE
angle = Number(initial_ouverture_2)
pt = Point(cluster.pt_6)
pt_2 = Point(cluster.pt_5)
pl = ConstructPlane(Origin=pt, XAxis=expr("{0,0,1}", Vector(78.26149335, 0, 0)), YAxis=expr("{0,-1,0}", Vector(0, 1, 0)))
pl_2 = ConstructPlane(Origin=pt_2, XAxis=expr("{0,0,1}", Vector(78.26149335, 0, 0)), YAxis=expr("{0,-1,0}", Vector(0, 1, 0)))
deplane = DeconstructPlane(Plane=pl)  # -> Origin, XAxis, YAxis, ZAxis
deplane_2 = DeconstructPlane(Plane=pl_2)  # -> Origin, XAxis, YAxis, ZAxis
rot3d = Rotate3D(Geometry=pl_2, Angle=expr("-x", degrees(angle)), Center=deplane_2.Origin, Axis=deplane_2.YAxis)  # -> Geometry, Transform
rot3d_2 = Rotate3D(Geometry=pl, Angle=degrees(angle), Center=deplane.Origin, Axis=deplane.YAxis)  # -> Geometry, Transform

# ---- group: CONFIG : START / TWIST
angle_2 = Number(initial_twist_2)
pln = Plane(rot3d.Geometry)
pln_2 = Plane(rot3d_2.Geometry)
deplane_3 = DeconstructPlane(Plane=pln_2)  # -> Origin, XAxis, YAxis, ZAxis
deplane_4 = DeconstructPlane(Plane=pln)  # -> Origin, XAxis, YAxis, ZAxis
multiplication = Multiplication(A=angle_2, B=intial_symetric_2)
rot3d_3 = Rotate3D(Geometry=pln, Angle=expr("-x", degrees(multiplication)), Center=deplane_4.Origin, Axis=expr("{0,0,1}", Vector(0, 0, 1)))  # -> Geometry, Transform
rot3d_4 = Rotate3D(Geometry=pln_2, Angle=degrees(angle_2), Center=deplane_3.Origin, Axis=expr("{0,0,1}", Vector(0, 0, 1)))  # -> Geometry, Transform

# ----
mframe = Frame(rot3d_3.Geometry)
mframe_2 = Frame(rot3d_4.Geometry)
fe = ClusterOutput(mframe)
fs = ClusterOutput(mframe_2)

# ==== cluster Cluster_2
initial_a = ClusterInput()
initial_a_2 = Number(initial_a)
cluster = Cluster(X=initial_a_2, Z=0)  # -> pt_6, pt_4, pt_5

# ---- group: CONFIG : START
pt = Point(cluster.pt_6)
pt_2 = Point(cluster.pt_5)
pl = ConstructPlane(Origin=pt, XAxis=expr("{0,0,1}", Vector(78.26149335, 0, 0)), YAxis=expr("{0,-1,0}", Vector(0, 1, 0)))
pl_2 = ConstructPlane(Origin=pt_2, XAxis=expr("{0,0,1}", Vector(78.26149335, 0, 0)), YAxis=expr("{0,-1,0}", Vector(0, 1, 0)))

# ----
mframe = Frame(pl_2)
mframe_2 = Frame(pl)
fe = ClusterOutput(mframe)
fs = ClusterOutput(mframe_2)

# ==== cluster Cluster
X = ClusterInput()
Z = ClusterInput()
pt = ConstructPoint(XCoordinate=expr("x/2", X), YCoordinate=0, ZCoordinate=0)
pt_2 = ConstructPoint(XCoordinate=expr("-x/2", X), YCoordinate=0, ZCoordinate=0)
pt_3 = ConstructPoint(XCoordinate=0, YCoordinate=0, ZCoordinate=Z)
pt_4 = ClusterOutput(pt_3)
pt_5 = ClusterOutput(pt)
pt_6 = ClusterOutput(pt_2)
