# Grasshopper definition 20160320_link_orient.gh (Grasshopper 0.9.76)
# plug-ins: TMarsupilami

yz = YZPlane(Origin=Point(0, 0, 0))
Z = UnitZ(Factor=0.2)
yz_2 = YZPlane(Origin=Point(0, 0, 0))
pln = Plane(Plane(origin=(0, 0, 0), x=(0, 0, 1), y=(0.08715574275, -0.9961946981, 0)))
pt = Point(<point referenced from the Rhino model>)
move = Move(Geometry=yz_2, Motion=expr("-x", Z))  # -> Geometry, Transform
move_2 = Move(Geometry=yz, Motion=Z)  # -> Geometry, Transform
move_3 = Move(Geometry=pln, Motion=pt)  # -> Geometry, Transform
xy = XYPlane(Origin=pt)
rotate = Rotate(Geometry=move.Geometry, Angle=degrees(Slider(-48, range=-180..180)), Plane=PlaneXY(0, 0, 0))  # -> Geometry, Transform
fdis = FrameDisplay(
    Frame=[move_2.Geometry, rotate.Geometry],
    ScaleFactor=0.3,
    LineWidth=[1, 1, 2],
    Color=[RGB(255, 0, 0), RGB(0, 255, 0), RGB(0, 0, 255)])
pln_2 = Plane(move_3.Geometry)
orient = OrientALink(FirstFrame=move_2.Geometry, SecondFrame=rotate.Geometry, ReferenceFrame=pln_2)  # -> rF, F1, F2
orient_2 = Orient(Geometry=[move_2.Geometry, rotate.Geometry], Source=orient.rF, Target=pln_2)  # -> Geometry, Transform
col = Colour([RGB(255, 0, 0), RGB(0, 255, 0), RGB(255, 255, 255)])
fdis_2 = FrameDisplay(Frame=orient_2.Geometry, ScaleFactor=0.3, LineWidth=[1, 1, 2], Color=[RGB(255, 0, 0), RGB(0, 255, 0), RGB(0, 0, 255)])
fdis_3 = FrameDisplay(
    Frame=[orient.F2, orient.F1],
    ScaleFactor=0.3,
    LineWidth=[1, 1, 2],
    Color=[RGB(255, 0, 0), RGB(0, 255, 0), RGB(0, 0, 255)])
fdis_4 = FrameDisplay(Frame=[pln_2, orient.rF], ScaleFactor=0.2, LineWidth=[1, 1, 2], Color=col)
