# Grasshopper definition RelaxGridshell.gh (Grasshopper 0.9.76)
# plug-ins: TMarsupilami, Kangaroo2 Components, Compass

r = Slider(8, range=0..10)
teta = Slider(90, range=-90..90)
h = Slider(4.5, range=1..5)
w = Slider(2, range=0.5..3)

pt = Point(Point(-0.001942589639, 0.003099870188, 0))
dome_generation = CSharpScript(r=r, h=h, w=w, teta=teta, pt=pt)  # -> output, R, D1, D2, gsSrf, domainSrf, cuttingSrf, A; inputs r: Double, h: Double, w: Double, teta: Double, pt: Point3d
# ---------- dome_generation: C# ----------
    Transform xform = Transform.Translation(pt.X, pt.Y, pt.Z);
    double t = 0.5;
    R = (r * r + h * h) / (2 * h);

    double alpha_gs = Math.Acos(((double) R - h) / (double) R);
    double alpha_domain = Math.Acos(((double) R - (h + (2 * (double) R - h) * t)) / (double) R);

    Arc arc_gs = new Arc(new Point3d(-r, 0, 0), new Point3d(0, 0, h), new Point3d(r, 0, 0));

    double X = Math.Sqrt(Math.Pow(((double) R), 2) - Math.Pow((double) R - (h + (2 * (double) R - h) * t), 2));
    Arc arc_domain = new Rhino.Geometry.Arc(new Point3d(-X, 0, -(2 * (double) R - h) * t), new Point3d(0, 0, h), new Point3d(X, 0, -(2 * (double) R - h) * t));

    Arc Arc1 = new Rhino.Geometry.Arc(new Point3d(-X, 0, -(2 * (double) R - h) * t), new Point3d(0, 0, h), new Point3d(X, 0, -(2 * (double) R - h) * t));
    Arc1.Transform(xform);
    D1 = Arc1;

    Arc Arc2 = new Rhino.Geometry.Arc(new Point3d(-X * Math.Cos(Math.PI * teta / 180), -X * Math.Sin(Math.PI * teta / 180), -(2 * (double) R - h) * t), new Point3d(0, 0, h), new Point3d(X * Math.Cos(Math.PI * teta / 180), X * Math.Sin(Math.PI * teta / 180), -(2 * (double) R - h) * t));
    Arc2.Transform(xform);
    D2 = Arc2;

    Line axe = new Line(0, 0, 0, 0, 0, 1);
    gsSrf = RevSurface.Create(arc_gs.ToNurbsCurve(), axe, 0.0, Math.PI);
    domainSrf = RevSurface.Create(arc_domain.ToNurbsCurve(), axe, 0.0, Math.PI);

    X = r + 5 * w;
    cuttingSrf = Brep.CreateFromCornerPoints(new Point3d(X, X, 0), new Point3d(-X, X, 0), new Point3d(-X, -X, 0), new Point3d(X, -X, 0), w / 100);

    ((RevSurface) gsSrf).Transform(xform);
    ((RevSurface) domainSrf).Transform(xform);
    ((Brep) cuttingSrf).Transform(xform);
# ---------- end dome_generation ----------
panel = Panel(dome_generation.R)
crv = Curve(dome_generation.D1)
crv_2 = Curve(dome_generation.D2)
brep = Brep(dome_generation.gsSrf)
brep_2 = Brep(dome_generation.domainSrf)
brep_3 = Brep(dome_generation.cuttingSrf)

Z = UnitZ(Factor=1)
button = Button()
directrices = ProcessDirectrices(Directrix1=crv, Directrix2=crv_2, Intersection_tolerance=0, Overlap_tolerance=0)  # -> Directrix1, Directrix2, Directrix3, Directrix4, IntersectionPoint, TangentH, TangentV, TangentD1, TagentD2
grab = Grab(On=True, Strength=1, Range=3)  # -> Grab, Anchors
compass_a_w_w = CompassAWW(
    Directrix1=directrices.Directrix1,
    Directrix2=directrices.Directrix2,
    Directrix3=directrices.Directrix3,
    Directrix4=directrices.Directrix4,
    DomainSurface=brep_2,
    W=w,
    RefineFactor=1,
    Intersection_tolerance=0.001,
    Overlap_tolerance=0.001)  # -> Informations, PolylinesH, PolylinesV, PolylinesD1, PolylinesD2, OriginPoint
number_slider = Slider(1, range=-1..1)
trim = Trim(
    Polylines=compass_a_w_w.PolylinesH,
    CuttingBrep=brep_3,
    Output=number_slider,
    IncludeNonSecantCrv=True,
    Intersection_tolerance=0.001)
trim_2 = Trim(
    Polylines=compass_a_w_w.PolylinesV,
    CuttingBrep=brep_3,
    Output=number_slider,
    IncludeNonSecantCrv=True,
    Intersection_tolerance=0.001)
trim_3 = Trim(
    Polylines=compass_a_w_w.PolylinesD1,
    CuttingBrep=brep_3,
    Output=number_slider,
    IncludeNonSecantCrv=True,
    Intersection_tolerance=0.001)
trim_4 = Trim(
    Polylines=compass_a_w_w.PolylinesD2,
    CuttingBrep=brep_3,
    Output=number_slider,
    IncludeNonSecantCrv=True,
    Intersection_tolerance=0.001)
addition = Addition(A=directrices.TangentH, B=directrices.TangentV)
subtraction = Subtraction(A=directrices.TangentH, B=directrices.TangentV)
orient = Orient(Polylines=trim, GuideVector=directrices.TangentH)
orient_2 = Orient(Polylines=trim_2, GuideVector=directrices.TangentV)
crv_3 = Curve([orient, orient_2])
end = EndPoints(Curve=crv_3)  # -> Start, End
anchor = Anchor(Point=[end.Start, end.End], Strength=10000)
rod = Rod(Polyline=crv_3, LengthFactor=1, AngleFactor=0, AxialStrength=10, BendStrength=1)
panel_2 = Panel(rod)
solver = Solver(GoalObjects=flatten([grab.Grab, rod, anchor]), Reset=Button(), Threshold=1e-15, Tolerance=0.01, On=Toggle(True))  # -> I, V, O
zombiesolver = ZombieSolver(GoalObjects=[anchor, rod, grab.Grab], Threshold=1e-10, Tolerance=0.01, MaxIterations=50000)  # -> I, V, O; disabled
orient_3 = Orient(Polylines=trim_3, GuideVector=subtraction)
orient_4 = Orient(Polylines=trim_4, GuideVector=addition)
model = Model(PolylinesH=orient, PolylinesV=orient_2, PolylinesD1=orient_3, PolylinesD2=orient_4, W=w)
scale_factor = Slider(-3.9, range=-10..10)
gsmesh = GSMesh(model)
lcnodal = LCNodal(
    Number=1,
    Title="Nodal Uniform",
    Description="Uniform nodal loading of the gridshell.",
    NodalUniformLoad=Z,
    GSMesh=gsmesh)
gsmesh_relax_2 = GSMeshRelax2(
    GSMesh=gsmesh,
    GSLoadCase=lcnodal,
    Kx=100,
    Ky=100,
    Kz=100,
    Iteration_max="2000",
    Iterations_groupby="2000",
    Reset=Button())  # -> info, Xi, Xt, Vt, LMt, Rt, Fext, Ect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
pline = PolyLine(Vertices=gsmesh_relax_2.Xt, Closed=False)
gridviewer = GridViewer(GSMesh=gsmesh, GridPlane=PlaneXY(0, 0, 0), Teta=90, TrueLength=False)  # -> PolylinesH, PolylinesV, PolylinesD1, PolylinesD2
_10º = PowerOf10(Value=scale_factor)
model_2 = Model(
    PolylinesH=gridviewer.PolylinesH,
    PolylinesV=gridviewer.PolylinesV,
    PolylinesD1=gridviewer.PolylinesD1,
    PolylinesD2=gridviewer.PolylinesD2,
    W=w)
gsmesh_2 = GSMesh(model_2)
mesh_frames = MeshFramesViewer(GSMesh=gsmesh)  # -> MaterialFrameH, MaterialFrameV, MaterialFrameD1, MaterialFrameD2, InteriorPoints, InteriorPointsAxes
mesh_frames_2 = MeshFramesViewer(GSMesh=gsmesh_2)  # -> MaterialFrameH, MaterialFrameV, MaterialFrameD1, MaterialFrameD2, InteriorPoints, InteriorPointsAxes
number_slider_2 = Slider(0, range=0..10)
mframe = Frame(mesh_frames.MaterialFrameH)
mframe_2 = Frame(mesh_frames.MaterialFrameV)
scale_factor_2 = Slider(-3.7, range=-10..10)
mframe_3 = Frame(mesh_frames_2.MaterialFrameH)
mframe_4 = Frame(mesh_frames_2.MaterialFrameV)
_10º_2 = PowerOf10(Value=scale_factor_2)
item = TreeItem(Tree=mframe, Path=number_slider_2, Index=0, Wrap=True)
item_2 = TreeItem(Tree=mframe_3, Path=number_slider_2, Index=0, Wrap=True)
bench_grid_2d = BenchGrid2D(
    RestPositionH=mframe_3,
    InitialPositionH=mframe,
    RestPositionV=mframe_4,
    InitialPositionV=mframe_2,
    SectionB1="0.2",
    SectionB2="0.2",
    Iteration_max="10000",
    Reset=Button())
config = ValueList({"Rest": 0, "Initial": 1, "Actual": 2}, selected="Actual")
scale_factor_3 = Slider(0.4, range=-10..10)
config_2 = ValueList({"Rest": 0, "Initial": 1, "Actual": 2}, selected="Actual")
mbeam = Beam(bench_grid_2d)
mbeam_2 = Beam(mbeam)

panel_3 = Panel(_10º)
Q = BeamQ(Beam=mbeam_2, Scale=panel_3, RestActual=config)  # -> Qr, Ql, Qmid, D
preview = CustomPreview(Geometry=Q.D, Shader=ColourSwatch(SwatchColor=RGB(237, 230, 28)))

panel_4 = Panel(_10º)
M = BeamM(Beam=mbeam_2, Scale=panel_4, RestActual=config)  # -> Mr, Ml, D1, D2
move = Move(Geometry=[M.D1, M.D2], Motion=Vector(0, 0, 0))  # -> Geometry, Transform
preview_2 = CustomPreview(Geometry=move.Geometry, Shader=ColourSwatch(SwatchColor=RGB(0, 255, 229)))

panel_5 = Panel(_10º)
V = BeamV(Beam=mbeam_2, Scale=panel_5, RestActual=config)  # -> Vr, Vl, Vmid, D1, D2
preview_3 = CustomPreview(Geometry=[V.D1, V.D2], Shader=ColourSwatch(SwatchColor=RGB(55, 255, 0)))

mbeam_3 = Beam(mbeam_2)  # disabled

swatch = ColourSwatch(SwatchColor=RGB(114, 95, 222))
energy = BeamEnergy(Beam=mbeam_3, Scale=_10º_2, Configuration=config)  # -> AxialEnergy, BendingEnergy, TwistingEnergy, DiagramEa, DiagramEb, DiagramEt
preview_4 = CustomPreview(Geometry=energy.DiagramEb, Shader=swatch)
preview_5 = CustomPreview(Geometry=energy.DiagramEt, Shader=swatch)

item_3 = ListItem(List=bench_grid_2d, Index=Slider(15, range=0..20), Wrap=True)
geometry = BeamGeometry(Beam=mbeam, Configuration=config_2)  # -> MaterialFrames, simplify(Envelope3D)
_10º_3 = PowerOf10(Value=scale_factor_3)

panel_6 = Panel(_10º_3)
ε = BeamΕ(Beam=mbeam_3, Scale=panel_6, RestActual=config)  # -> Εr, Εl, Εmid, DiagramΕ
preview_6 = CustomPreview(Geometry=ε.DiagramΕ, Shader=ColourSwatch(SwatchColor=RGB(255, 255, 255)))

panel_7 = Panel(_10º_3)
κ = BeamΚ(Beam=mbeam_3, Scale=panel_7, RestActual=config)  # -> Κbl, Κbr, Κbmid, D1, D2
preview_7 = CustomPreview(Geometry=[κ.D1, κ.D2], Shader=ColourSwatch(SwatchColor=RGB(209, 25, 25)))

panel_8 = Panel(_10º_3)
τ = BeamΤ(Beam=mbeam_3, Scale=panel_8, RestActual=config)  # -> Τr, Τl, Τmid, DiagramΤ
preview_8 = CustomPreview(Geometry=τ.DiagramΤ, Shader=ColourSwatch(SwatchColor=RGB(237, 230, 28)))

geometry_2 = BeamGeometry(Beam=item_3, Configuration=config_2)  # -> simplify(MaterialFrames), Envelope3D
bdis = BeamInternals(Beam=mbeam)  # -> Frames, FramesMid, FextG, MextL, FextG_2, MextL_2, FrG, MrL
brep_4 = Brep(geometry.Envelope3D)
deplane = DeconstructPlane(Plane=geometry.MaterialFrames)  # -> Origin, XAxis, YAxis, ZAxis
item_4 = ListItem(List=bdis.Frames, Index=Slider(16, range=0..100), Wrap=True)
fdis = FrameDisplay(
    Frame=geometry.MaterialFrames,
    ScaleFactor=1,
    LineWidth=[2, 1, 1],
    Color=[RGB(0, 0, 255), RGB(255, 0, 0), RGB(0, 255, 0)])
intcrv = Interpolate(Vertices=geometry_2.MaterialFrames, Degree=3, Periodic=False, KnotStyle=1)  # -> Curve, Length, Domain
vdis = VectorDisplay(Anchor=deplane.Origin, Vector=deplane.ZAxis)
scale_factor_4 = Slider(-4, range=-10..10)
explode = Slider(5, range=0..10)
pt_2 = Point(item_4)
Y = UnitY(Factor=explode)
_10º_4 = PowerOf10(Value=scale_factor_4)

panel_9 = Panel(_10º_4)
V_2 = BeamV(Beam=mbeam_3, Scale=panel_9, RestActual=config)  # -> Vr, Vl, Vmid, D1, D2
move_2 = Move(Geometry=[V_2.D1, V_2.D2], Motion=expr("2*x", Y))  # -> Geometry, Transform
preview_9 = CustomPreview(Geometry=move_2.Geometry, Shader=ColourSwatch(SwatchColor=RGB(55, 255, 0)))

panel_10 = Panel(_10º_4)
N = BeamDiagram(Beam=mbeam_3, Scale=panel_10, RestActual=config)  # -> Nl, Nr, Nmid, D
move_3 = Move(Geometry=N.D, Motion=Y)  # -> Geometry, Transform
preview_10 = CustomPreview(Geometry=move_3.Geometry, Shader=ColourSwatch(SwatchColor=RGB(255, 255, 255)))

panel_11 = Panel(_10º_4)
Q_2 = BeamQ(Beam=mbeam_3, Scale=panel_11, RestActual=config)  # -> Qr, Ql, Qmid, D
move_4 = Move(Geometry=Q_2.D, Motion=expr("4*x", Y))  # -> Geometry, Transform
preview_11 = CustomPreview(Geometry=move_4.Geometry, Shader=ColourSwatch(SwatchColor=RGB(237, 230, 28)))

panel_12 = Panel(_10º_4)
M_2 = BeamM(Beam=mbeam_3, Scale=panel_12, RestActual=config)  # -> Mr, Ml, D1, D2
move_5 = Move(Geometry=[M_2.D1, M_2.D2], Motion=expr("3*x", Y))  # -> Geometry, Transform
preview_12 = CustomPreview(Geometry=move_5.Geometry, Shader=ColourSwatch(SwatchColor=RGB(255, 0, 0)))

num = Number(M_2.Ml)

num_2 = Number([N.Nr, N.Nl, N.Nmid])
bnd = Bounds(Numbers=num_2)
dedomain = DeconstructDomain(Domain=bnd)  # -> expr("round(x)", Start), expr("round(x)", End)
min = Panel(dedomain.Start)
max = Panel(dedomain.End)

num_3 = Number(V_2.Vmid)

num_4 = Number([V_2.Vr, V_2.Vl, V_2.Vmid])
bnd_2 = Bounds(Numbers=num_4)
dedomain_2 = DeconstructDomain(Domain=bnd_2)  # -> expr("round(x)", Start), expr("round(x)", End)
min_2 = Panel(dedomain_2.Start)
max_2 = Panel(dedomain_2.End)

num_5 = Number([M_2.Mr, M_2.Ml])
bnd_3 = Bounds(Numbers=num_5)
dedomain_3 = DeconstructDomain(Domain=bnd_3)  # -> expr("round(x)", Start), expr("round(x)", End)
min_3 = Panel(dedomain_3.Start)
max_3 = Panel(dedomain_3.End)

num_6 = Number([Q_2.Qr, Q_2.Ql, Q_2.Qmid])
bnd_4 = Bounds(Numbers=num_6)
dedomain_4 = DeconstructDomain(Domain=bnd_4)  # -> expr("round(x)", Start), expr("round(x)", End)
min_4 = Panel(dedomain_4.Start)
max_4 = Panel(dedomain_4.End)

panel_13 = Panel(num)
scale_factor_5 = Slider(-6.1, range=-10..10)

# ---- group: DISPLAY fext mext
explode_2 = BooleanToggle(False)
cs = ValueList({"Global": True, "Local": False}, selected="Global")
dforce = DistributedForce(bdis.FextG_2)
dmoment = DistributedMoment(bdis.MextL_2)
_10º_5 = PowerOf10(Value=scale_factor_5)
f_disp = ForceDisplayDistributedF(DistributedForce=dforce, Project=explode_2, CoordinateSystem=cs, Scale=_10º_5)
m_disp = MomentDisplayDistributedM(DistributedMoment=dmoment, Project=explode_2, CoordinateSystem=cs, Scale=_10º_5)

# ----
_10º_6 = PowerOf10(Value=scale_factor_5)

# ---- group: DISPLAY Fext Mext
explode_3 = BooleanToggle(True)
cs_2 = ValueList({"Global": True, "Local": False}, selected="Global")
cforce = ConcentratedForce(bdis.FextG)
cmoment = ConcentratedMoment(bdis.MextL)
cforce_2 = ConcentratedForce(bdis.FrG)
cmoment_2 = ConcentratedMoment(bdis.MrL)
f_disp_2 = ForceDisplayConcentratedF(ConcentratedForce=cforce_2, Project=explode_3, CoordinateSystem=cs_2, Scale=_10º_6)
m_disp_2 = MomentDisplayConcentratedM(ConcentratedMoment=cmoment_2, Project=explode_3, CoordinateSystem=cs_2, Scale=_10º_6)
f_disp_3 = ForceDisplayConcentratedF(ConcentratedForce=cforce, Project=explode_3, CoordinateSystem=cs_2, Scale=_10º_6)
m_disp_3 = MomentDisplayConcentratedM(ConcentratedMoment=cmoment, Project=explode_3, CoordinateSystem=True, Scale=_10º_6)
