# Grasshopper definition bench_A_defense.gh (Grasshopper 0.9.76)
# plug-ins: Python Interpreter, TMarsupilami

N = Slider(3, range=0..100)

elongation = Slider(1, range=0.5..1.5)
theta_0 = Slider(0, range=-20..20)

twistmodulo = Slider(0, range=-2..2)
list = ValueList({"symetric": 1, "antisymetric": -1}, selected="symetric")
a = Slider(2, range=0..20)
ouverture = Slider(120, range=0..160)
twist = Slider(0, range=-45..45)

shift_x_y = BooleanToggle(True)
b1 = Slider(0.04, range=0.01..0.5)
b2 = Slider(0.06, range=0..0.5)

f1 = Slider(1, range=1..4)
f1_2 = Slider(1, range=1..4)
t = Slider(0, range=0..1)

multiplication = Multiplication(A="10", B=1.570796327)

# ----
# SECTIONS DEF
sections = PythonScript(shift=shift_x_y, b1=b1, b2=b2, f1=f1, f2=f1_2)  # -> P, R1, R2; inputs shift: Boolean
# ---------- sections: Python ----------
import Rhino.Geometry as rg

if shift:
    lx = b2
    ly = b1
    fx = f2
    fy = f1
    P = rg.Plane.WorldXY
else:
    lx = b1
    ly = b2
    fx = f1
    fy = f2
    P = rg.Plane.WorldXY

P1 = rg.Plane.WorldXY
P1.Origin = P1.Origin - (lx/2)*P1.XAxis - (ly/2)*P1.YAxis
R1 = rg.Rectangle3d(P1, lx, ly)

P2 = rg.Plane.WorldXY
P2.Origin = P2.Origin - (lx/(2*fx))*P2.XAxis - (ly/(2*fy))*P2.YAxis
 
R2 = rg.Rectangle3d(P2, lx/fx, ly/fy)


print lx
print ly
# ---------- end sections ----------
fdis = FrameDisplay(Frame=sections.P, ScaleFactor=2, LineWidth=[0, 3, 3], Color=[RGB(0, 0, 255), RGB(255, 0, 0), RGB(0, 255, 0)])
crv = Curve([sections.R1, sections.R2])

# ----
# INITIAL CONFIG
start_end_frames = StartEndFrames(initial_a=a, initial_ouverture=ouverture, initial_twist=twist, intial_symetric=list)  # -> fs, fe

# ----
# Load results from ABAQUS XLS FILE and Plot internal force/moment diagram
toggle = BooleanToggle(True)
crv_2 = Curve(<curve referenced from the Rhino model>)
disc = Discontinuity(Curve=crv_2, Level=1)  # -> Points, Parameters
lng = ListLength(List=disc.Points)
int = Integer(expr("(x-1)/2", lng))
dom = ConstructDomain(DomainStart=2, DomainEnd=98)
intcrv = Interpolate(Vertices=disc.Points, Degree=3, Periodic=False, KnotStyle=1)  # -> Curve, Length, Domain
pline = PolyLine(Vertices=disc.Points, Closed=False)
subset = SubList(Domain=dom, Wrap=True)  # -> simplify(List), Index

ne = Integer(N)
geom = DefineBeamGeometrySingle(StartFrame=start_end_frames.fs, EndFrame=start_end_frames.fe, EdgeCount=ne, TwistModulo=twistmodulo)  # -> BeamCenterline, Frames

# ----
# REST CONFIG
len = Length(Curve=geom.BeamCenterline)
multiplication_2 = Multiplication(A=elongation, B="10")
cluster = Cluster_2(initial_a=multiplication_2)  # -> fs, fe

mid = Panel(int)
len_2 = Length(Curve=pline)
len_3 = Length(Curve=intcrv.Curve)
bang = ExplodeTree(Data=subset.List)  # -> Branch0, Branch1, Branch2, Branch3, Branch4, Branch5, Branch6, Branch7, Branch8

multiplication_3 = Multiplication(A=ne, B=t)
int_2 = Integer(multiplication_3)
c_script = CSharpScript(
    N=ne,
    n=int_2,
    R1=sections.R1,
    R2=sections.R2,
    Reference=["Z:\GITHUB\TMARSUPILAMI2\SRC\TMARSUPILAMI.GH\BIN\TMarsupilami.MathLib.dll", "Z:\GITHUB\TMARSUPILAMI2\SRC\TMARSUPILAMI.GH\BIN\TMarsupilami.Gh.dll"])  # -> out, bx, by; inputs N: Int32, n: Int32, R1: Rectangle3d, R2: Rectangle3d
# ---------- c_script: C# ----------
    double[] b1, b2;
    b1 = new double[N];
    b2 = new double[N];

    if (n < 1)
    {
      for (int i = 0; i < N; i++)
      {
        b1[i] = R2.Width;
        b2[i] = R2.Height;
      }
    }
    else if (n > N+1)
    {
      for (int i = 0; i < N+1; i++)
      {
        b1[i] = R1.Width;
        b2[i] = R1.Height;
      }
    }
    else
    {
      for (int i = 0; i < n; i++)
      {
        b1[i] = R1.Width;
        b2[i] = R1.Height;
      }
      for (int i = n; i < N; i++)
      {
        b1[i] = R2.Width;
        b2[i] = R2.Height;
      }
    }



    // output
    bx = b1;
    by = b2;
# ---------- end c_script ----------

geom_2 = DefineBeamGeometrySingle(StartFrame=cluster.fs, EndFrame=cluster.fe, EdgeCount=ne, TwistModulo=0)  # -> BeamCenterline, Frames
rz = ZRotateAFrame(FrameS=geom_2.Frames, ZTwistAngleS=theta_0)

item = ListItem(List=disc.Points, Index=mid, Wrap=True)
pdecon = Deconstruct(Point=item)  # -> XComponent, YComponent, ZComponent
panel = Panel(bang.Branch1)
X = Number(bang.Branch1)
panel_2 = Panel(pdecon.XComponent)
panel_3 = Panel(len_2)
panel_4 = Panel(len_3)
panel_5 = Panel(pdecon.YComponent)
panel_6 = Panel(pdecon.ZComponent)

crv_3 = Curve(geom_2.BeamCenterline)
mframe = Frame(rz)

crv_4 = Curve(geom.BeamCenterline)
mframe_2 = Frame(geom.Frames)

# ---- group: Display Frames
cull_i = CullIndex(List=mframe, Indices=[0, -1], Wrap=True)
item_2 = ListItem(List=mframe, Index=[0, -1], Wrap=True)
fdis_2 = FrameDisplay(Frame=cull_i, ScaleFactor=1, LineWidth=[2, 1, 1], Color=[RGB(0, 0, 255), RGB(255, 0, 0), RGB(0, 255, 0)])
fdis_3 = FrameDisplay(Frame=item_2, ScaleFactor=4, LineWidth=3, Color=[RGB(0, 0, 255), RGB(255, 0, 0), RGB(0, 255, 0)])

# ---- group: Display Brep
c_script_2 = CSharpScript(
    centerline=crv_3,
    F=mframe,
    n=int_2,
    P=sections.P,
    R1=sections.R1,
    R2=sections.R2,
    Reference=["Z:\GITHUB\TMARSUPILAMI2\SRC\TMARSUPILAMI.GH\BIN\TMarsupilami.MathLib.dll", "Z:\GITHUB\TMARSUPILAMI2\SRC\TMARSUPILAMI.GH\BIN\TMarsupilami.Gh.dll"])  # -> out, C, S, B; inputs centerline: Curve, F: list, n: Int32, P: Plane, R1: Rectangle3d, R2: Rectangle3d
# ---------- c_script_2: C# ----------
    MFrame[ ] f1, f2;
    Curve c1, c2;
    Curve[] s1, s2;
    Brep b1, b2;

    var sweep = new Rhino.Geometry.SweepOneRail();
    sweep.MiterType = 0;
    sweep.GlobalShapeBlending = false;

    var sweep2 = new Rhino.Geometry.SweepTwoRail();

    if (n < 1)
    {
      f1 = new MFrame[0];
      f2 = new MFrame[F.Count];
      for (int i = 0; i < F.Count; i++)
      {
        f2[i] = (MFrame) F[i];
      }
      c1 = null;
      c2 = centerline;
    }
    else if (n > F.Count)
    {
      f2 = new MFrame[0];
      f1 = new MFrame[F.Count];
      for (int i = 0; i < F.Count; i++)
      {
        f1[i] = (MFrame) F[i];
      }
      c1 = centerline;
      c2 = null;
    }
    else
    {
      f1 = new MFrame[n];
      for (int i = 0; i < f1.Length; i++)
      {
        f1[i] = (MFrame) F[i];
      }
      f2 = new MFrame[F.Count - n + 1];
      for (int i = 0; i < f2.Length; i++)
      {
        f2[i] = (MFrame) F[n - 1 + i];
      }

      // changing point
      double param;
      var point = f1[n - 1].Origin.Cast();
      centerline.ClosestPoint(point, out param);
      var subCurves = centerline.Split(param);
      c1 = subCurves[0];
      c2 = subCurves[1];
    }

    var c = new List<Curve>();
    var s = new List<Curve>();
    var f = new List<MFrame>();
    var b = new List<Brep>();

    // Sweep over C1
    if (c1 != null)
    {
      var pts = new Point3d[f1.Length];
      s1 = new Rhino.Geometry.Curve[f1.Length];
      for (int i = 0; i < f1.Length; i++)
      {
        var xform = Transform.PlaneToPlane(P, f1[i].Cast());
        var polyline = R1.ToPolyline();
        polyline.Transform(xform);
        s1[i] = new Rhino.Geometry.PolylineCurve(polyline);
        pts[i] = polyline[0];
      }
      var rail_ext = Rhino.Geometry.Curve.CreateInterpolatedCurve(pts, 3);
      var rail_int = c1;
      b1 = sweep2.PerformSweep(rail_int, rail_ext, s1)[0];

      var cap_1 = Rhino.Geometry.Brep.CreatePlanarBreps(s1[0])[0];
      var cap_2 = Rhino.Geometry.Brep.CreatePlanarBreps(s1[f1.Length - 1])[0];
      b1 = Brep.JoinBreps(new Brep[3]{cap_1, b1, cap_2}, 1e-9)[0];

      c.Add(c1);
      s.AddRange(s1);
      b.Add(b1);
    }
    if (c2 != null)
    {
      var pts = new Point3d[f2.Length];
      s2 = new Rhino.Geometry.Curve[f2.Length];
      for (int i = 0; i < f2.Length; i++)
      {
        var xform = Transform.PlaneToPlane(P, f2[i].Cast());
        var polyline = R2.ToPolyline();
        polyline.Transform(xform);
        s2[i] = new Rhino.Geometry.PolylineCurve(polyline);
        pts[i] = polyline[0];
      }
      var rail_ext = Rhino.Geometry.Curve.CreateInterpolatedCurve(pts, 3);
      var rail_int = c2;
      b2 = sweep2.PerformSweep(rail_int, rail_ext, s2)[0];

      var cap_1 = Rhino.Geometry.Brep.CreatePlanarBreps(s2[0])[0];
      var cap_2 = Rhino.Geometry.Brep.CreatePlanarBreps(s2[f2.Length - 1])[0];
      b2 = Brep.JoinBreps(new Brep[3]{cap_1, b2, cap_2}, 1e-9)[0];

      c.Add(c2);
      s.AddRange(s2);
      b.Add(b2);
    }

    // output
    C = c;
    S = s;
    B = b;
# ---------- end c_script_2 ----------
crv_5 = Curve(c_script_2.C)
crv_6 = Curve(c_script_2.S)
brep = Brep(c_script_2.B)
preview = CustomPreview(Geometry=brep, Shader=ColourSwatch(SwatchColor=RGB(10, 133, 255)))

# ---- group: Display Frames
cull_i_2 = CullIndex(List=mframe_2, Indices=[0, -1], Wrap=True)
item_3 = ListItem(List=mframe_2, Index=[0, -1], Wrap=True)
fdis_4 = FrameDisplay(Frame=cull_i_2, ScaleFactor=1, LineWidth=[2, 1, 1], Color=[RGB(0, 0, 255), RGB(255, 0, 0), RGB(0, 255, 0)])
fdis_5 = FrameDisplay(Frame=item_3, ScaleFactor=4, LineWidth=3, Color=[RGB(0, 0, 255), RGB(255, 0, 0), RGB(0, 255, 0)])

# ---- group: Display Brep
c_script_3 = CSharpScript(
    centerline=crv_4,
    F=mframe_2,
    n=int_2,
    P=sections.P,
    R1=sections.R1,
    R2=sections.R2,
    Reference=["Z:\Github\TMarsupilami2\src\TMarsupilami.Gh\bin\TMarsupilami.MathLib.dll", "Z:\Github\TMarsupilami2\src\TMarsupilami.Gh\bin\TMarsupilami.Gh.dll"])  # -> out, C, S, B; inputs centerline: Curve, F: list, n: Int32, P: Plane, R1: Rectangle3d, R2: Rectangle3d; same code as c_script_2
crv_7 = Curve(c_script_3.C)
crv_8 = Curve(c_script_3.S)
brep_2 = Brep(c_script_3.B)
preview_2 = CustomPreview(Geometry=brep_2, Shader=ColourSwatch(SwatchColor=RGB(255, 255, 255)))

# ----
list_2 = ValueList({"N": 3, "F1": 4, "F2": 5, "Q": 6, "M1": 7, "M2": 8}, selected="M2")
filter = StreamFilter(
    Gate=expr("x-3", list_2),
    Stream0=bang.Branch2,
    Stream1=bang.Branch3,
    Stream2=bang.Branch4,
    Stream3=bang.Branch5,
    Stream4=bang.Branch6,
    Stream5=bang.Branch7)
Y = Number(filter)
abs = Absolute(Value=Y)
bnd = Bounds(Numbers=abs)
dedomain = DeconstructDomain(Domain=bnd)  # -> Start, End
division = Division(A=Y, B=dedomain.End)
pt = ConstructPoint(XCoordinate=X, YCoordinate=division, ZCoordinate=0)
pt_2 = ConstructPoint(XCoordinate=X, YCoordinate=0, ZCoordinate=0)
pt_3 = Point(<point referenced from the Rhino model>)
ln = Line(StartPoint=pt_2, EndPoint=pt)
pline_2 = PolyLine(Vertices=pt, Closed=False)
intcrv_2 = Interpolate(Vertices=pt, Degree=3, Periodic=False, KnotStyle=1)  # -> Curve, Length, Domain
group = Group(Objects=ln)

fx = Panel("0")
fy = Panel("10")
fz = Panel("0")
vec = VectorXYZ(XComponent=fx, YComponent=fy, ZComponent=fz)  # -> Vector, Length

m1 = Panel("0")
m2 = Panel("0")
m3 = Panel("0")
vec_2 = VectorXYZ(XComponent=m1, YComponent=m2, ZComponent=m3)  # -> Vector, Length

fx_2 = Panel("0")
fy_2 = Panel("0")
fz_2 = Panel("0")
vec_3 = VectorXYZ(XComponent=fx_2, YComponent=fy_2, ZComponent=fz_2)  # -> Vector, Length

m1_2 = Panel("0")
m2_2 = Panel("0")
m3_2 = Panel("0")
vec_4 = VectorXYZ(XComponent=m1_2, YComponent=m2_2, ZComponent=m3_2)  # -> Vector, Length

geo = Geometry([group, intcrv_2.Curve])
move = Move(Geometry=geo, Motion=pt_3)  # -> Geometry, Transform
list_3 = ValueList({"FREE": 0, "PIN": 1, "CLAMPED": 2}, selected="CLAMPED")
list_4 = ValueList({"FREE": 0, "PIN": 1, "CLAMPED": 2}, selected="CLAMPED")

# ---- group: Beam A
sections_0 = Plane(rz)
sections_i = Plane(mframe_2)
section_b2 = Number(c_script.by)
section_b1 = Number(c_script.bx)

# ----
scale_factor = Slider(-3.7, range=-10..10)
dam = DataDam(DataA=sections_0, BufferDelay=10000000, BufferMode=0)
_10º = PowerOf10(Value=scale_factor)
reset = Button()
refine = Button()
max_iter = Panel("10000")
bench_1d = Bench1B(
    InitialPosition=sections_i,
    SectionB1=section_b1,
    SectionB2=section_b2,
    BoundaryConditionAtStart=list_3,
    BoundaryConditionAtEnd=list_4,
    ConcentratedForce=vec.Vector,
    ConcentratedMoment=vec_2.Vector,
    DistributedForce=vec_3.Vector,
    DistributedMoment=vec_4.Vector,
    Iteration_max=max_iter,
    Reset=reset,
    Refine=refine)
config = ValueList({"Rest": 0, "Initial": 1, "Actual": 2}, selected="Actual")
scale_factor_2 = Slider(-0.9, range=-10..10)
config_2 = ValueList({"Rest": 0, "Initial": 1, "Actual": 2}, selected="Actual")
mbeam = Beam(bench_1d)
mbeam_2 = Beam(mbeam)

swatch = ColourSwatch(SwatchColor=RGB(114, 95, 222))
energy = BeamEnergy(Beam=mbeam_2, Scale=_10º, Configuration=config)  # -> AxialEnergy, BendingEnergy, TwistingEnergy, DiagramEa, DiagramEb, DiagramEt
preview_3 = CustomPreview(Geometry=energy.DiagramEb, Shader=swatch)
preview_4 = CustomPreview(Geometry=energy.DiagramEt, Shader=swatch)

_10º_2 = PowerOf10(Value=scale_factor_2)

panel_7 = Panel(_10º_2)
ε = BeamΕ(Beam=mbeam_2, Scale=panel_7, RestActual=config)  # -> Εr, Εl, Εmid, DiagramΕ
preview_5 = CustomPreview(Geometry=ε.DiagramΕ, Shader=ColourSwatch(SwatchColor=RGB(255, 255, 255)))

panel_8 = Panel(_10º_2)
τ = BeamΤ(Beam=mbeam_2, Scale=panel_8, RestActual=config)  # -> Τr, Τl, Τmid, DiagramΤ
preview_6 = CustomPreview(Geometry=τ.DiagramΤ, Shader=ColourSwatch(SwatchColor=RGB(237, 230, 28)))

panel_9 = Panel(_10º_2)
κ = BeamΚ(Beam=mbeam_2, Scale=panel_9, RestActual=config)  # -> Κbl, Κbr, Κbmid, D1, D2
preview_7 = CustomPreview(Geometry=[κ.D1, κ.D2], Shader=ColourSwatch(SwatchColor=RGB(209, 25, 25)))

Q = BeamQ(Beam=mbeam_2, Scale=1, RestActual=config)  # -> Qr, Ql, Qmid, D
N_2 = BeamDiagram(Beam=mbeam_2, Scale=1, RestActual=config)  # -> Nl, Nr, Nmid, D
V = BeamV(Beam=mbeam_2, Scale=1, RestActual=config)  # -> Vr, Vl, Vmid, D1, D2
M = BeamM(Beam=mbeam_2, Scale=1, RestActual=config)  # -> Mr, Ml, D1, D2
geometry = BeamGeometry(Beam=mbeam, Configuration=config_2)  # -> MaterialFrames, Envelope3D
num = Number([N_2.Nr, N_2.Nl])
num_2 = Number([V.Vl, V.Vr])
num_3 = Number([M.Ml, M.Mr])
num_4 = Number([Q.Ql, Q.Qr])
bdis = BeamInternals(Beam=mbeam)  # -> Frames, FramesMid, FextG, MextL, FextG_2, MextL_2, FrG, MrL
fdis_6 = FrameDisplay(
    Frame=geometry.MaterialFrames,
    ScaleFactor=4,
    LineWidth=[2, 1, 1],
    Color=[RGB(0, 0, 255), RGB(255, 0, 0), RGB(0, 255, 0)])
bnd_2 = Bounds(Numbers=num)
bnd_3 = Bounds(Numbers=num_2)
bnd_4 = Bounds(Numbers=num_3)
bnd_5 = Bounds(Numbers=num_4)
item_4 = ListItem(List=bdis.Frames, Index=Slider(16, range=0..100), Wrap=True)
dedomain_2 = DeconstructDomain(Domain=bnd_2)  # -> Start, expr("1/x", End)
dedomain_3 = DeconstructDomain(Domain=bnd_3)  # -> Start, expr("1/x", End)
dedomain_4 = DeconstructDomain(Domain=bnd_4)  # -> Start, expr("1/x", End)
dedomain_5 = DeconstructDomain(Domain=bnd_5)  # -> Start, expr("1/x", End)
scale_factor_3 = Slider(-3.1, range=-10..10)
explode = Slider(3, range=0..10)
pt_4 = Point(item_4)
multiplication_4 = Multiplication(A=dedomain_2.End, B="0.75")
multiplication_5 = Multiplication(A=dedomain_3.End, B="0.75")
multiplication_6 = Multiplication(A=dedomain_4.End, B="0.75")
multiplication_7 = Multiplication(A=dedomain_5.End, B="0.75")
_10º_3 = PowerOf10(Value=scale_factor_3)
Z = UnitZ(Factor=1)

mframe_3 = Frame(bdis.Frames)
intcrv_3 = Interpolate(Vertices=mframe_3, Degree=3, Periodic=False, KnotStyle=1)  # -> Curve, Length, Domain
crv_9 = Curve(intcrv_3.Curve)

Y_2 = UnitY(Factor=1)
multiplication_8 = Multiplication(A=Y_2, B=explode)
multiplication_9 = Multiplication(A=0, B=multiplication_8)
multiplication_10 = Multiplication(A=1, B=multiplication_8)
multiplication_11 = Multiplication(A=2, B=multiplication_8)
multiplication_12 = Multiplication(A=3, B=multiplication_8)
multiplication_13 = Multiplication(A=Y_2, B="5")
addition = Addition(A=multiplication_13)
vec_5 = Vector(addition)
addition_2 = Addition(A=vec_5, B=multiplication_9)

panel_10 = Panel(multiplication_4)
N_3 = BeamDiagram(Beam=mbeam_2, Scale=panel_10, RestActual=config)  # -> Nl, Nr, Nmid, D
move_2 = Move(Geometry=N_3.D, Motion=addition_2)  # -> Geometry, Transform
preview_8 = CustomPreview(Geometry=move_2.Geometry, Shader=ColourSwatch(SwatchColor=RGB(255, 255, 255)))

num_5 = Number([N_3.Nr, N_3.Nl, N_3.Nmid])
bnd_6 = Bounds(Numbers=num_5)
dedomain_6 = DeconstructDomain(Domain=bnd_6)  # -> expr("round(x)", Start), expr("round(x)", End)
min = Panel(dedomain_6.Start)
max = Panel(dedomain_6.End)

addition_3 = Addition(A=vec_5, B=multiplication_10)

panel_11 = Panel(multiplication_5)
V_2 = BeamV(Beam=mbeam_2, Scale=panel_11, RestActual=config)  # -> Vr, Vl, Vmid, D1, D2
move_3 = Move(Geometry=[V_2.D1, V_2.D2], Motion=addition_3)  # -> Geometry, Transform
preview_9 = CustomPreview(Geometry=move_3.Geometry, Shader=ColourSwatch(SwatchColor=RGB(55, 255, 0)))

num_6 = Number(V_2.Vmid)

num_7 = Number([V_2.Vr, V_2.Vl, V_2.Vmid])
bnd_7 = Bounds(Numbers=num_7)
dedomain_7 = DeconstructDomain(Domain=bnd_7)  # -> expr("round(x)", Start), expr("round(x)", End)
min_2 = Panel(dedomain_7.Start)
max_2 = Panel(dedomain_7.End)

addition_4 = Addition(A=vec_5, B=multiplication_11)

panel_12 = Panel(multiplication_6)
M_2 = BeamM(Beam=mbeam_2, Scale=panel_12, RestActual=config)  # -> Mr, Ml, D1, D2
move_4 = Move(Geometry=[M_2.D1, M_2.D2], Motion=addition_4)  # -> Geometry, Transform
preview_10 = CustomPreview(Geometry=move_4.Geometry, Shader=ColourSwatch(SwatchColor=RGB(255, 0, 0)))

num_8 = Number(M_2.Ml)

num_9 = Number([M_2.Mr, M_2.Ml])
bnd_8 = Bounds(Numbers=num_9)
dedomain_8 = DeconstructDomain(Domain=bnd_8)  # -> expr("round(x)", Start), expr("round(x)", End)
min_3 = Panel(dedomain_8.Start)
max_3 = Panel(dedomain_8.End)

panel_13 = Panel(num_8)
addition_5 = Addition(A=vec_5, B=multiplication_12)

panel_14 = Panel(multiplication_7)
Q_2 = BeamQ(Beam=mbeam_2, Scale=panel_14, RestActual=config)  # -> Qr, Ql, Qmid, D
move_5 = Move(Geometry=Q_2.D, Motion=addition_5)  # -> Geometry, Transform
preview_11 = CustomPreview(Geometry=move_5.Geometry, Shader=ColourSwatch(SwatchColor=RGB(237, 230, 28)))

num_10 = Number([Q_2.Qr, Q_2.Ql, Q_2.Qmid])
bnd_9 = Bounds(Numbers=num_10)
dedomain_9 = DeconstructDomain(Domain=bnd_9)  # -> expr("round(x)", Start), expr("round(x)", End)
min_4 = Panel(dedomain_9.Start)
max_4 = Panel(dedomain_9.End)

scale_factor_4 = Slider(-6.1, range=-10..10)

# ---- group: Display Frames
cull_i_3 = CullIndex(List=mframe_3, Indices=[0, -1], Wrap=True)
item_5 = ListItem(List=mframe_3, Index=[0, -1], Wrap=True)
fdis_7 = FrameDisplay(Frame=cull_i_3, ScaleFactor=0.5, LineWidth=[2, 1, 1], Color=[RGB(0, 0, 255), RGB(255, 0, 0), RGB(0, 255, 0)])
fdis_8 = FrameDisplay(Frame=item_5, ScaleFactor=2, LineWidth=3, Color=[RGB(0, 0, 255), RGB(255, 0, 0), RGB(0, 255, 0)])

# ---- group: Display Brep
c_script_4 = CSharpScript(
    centerline=crv_9,
    F=mframe_3,
    P=sections.P,
    R1=sections.R1,
    R2=sections.R2,
    Reference=["Z:\GITHUB\TMARSUPILAMI2\SRC\TMARSUPILAMI.GH\BIN\TMarsupilami.MathLib.dll", "Z:\GITHUB\TMARSUPILAMI2\SRC\TMARSUPILAMI.GH\BIN\TMarsupilami.Gh.dll"])  # -> out, C, S, B; inputs centerline: Curve, F: list, n: Int32, P: Plane, R1: Rectangle3d, R2: Rectangle3d; same code as c_script_2
crv_10 = Curve(c_script_4.C)
crv_11 = Curve(c_script_4.S)
brep_3 = Brep(c_script_4.B)
preview_12 = CustomPreview(Geometry=brep_3, Shader=ColourSwatch(SwatchColor=RGBA(255, 247, 10, 194)))

# ---- group: DISPLAY fext mext
dforce = DistributedForce(bdis.FextG_2)
dmoment = DistributedMoment(bdis.MextL_2)
explode_2 = BooleanToggle(False)
cs = ValueList({"Global": True, "Local": False}, selected="Global")
_10º_4 = PowerOf10(Value=scale_factor_4)
f_disp = ForceDisplayDistributedF(DistributedForce=dforce, Project=explode_2, CoordinateSystem=cs, Scale=_10º_4)
m_disp = MomentDisplayDistributedM(DistributedMoment=dmoment, Project=explode_2, CoordinateSystem=cs, Scale=_10º_4)

# ----
filter_2 = StreamFilter(Gate=config, Stream0=brep, Stream2=brep_3)
move_6 = Move(Geometry=filter_2, Motion=[addition_2, addition_3, addition_4, addition_5])  # -> Geometry, Transform
_10º_5 = PowerOf10(Value=scale_factor_4)

# ---- group: DISPLAY Fext Mext
cforce = ConcentratedForce(bdis.FextG)
cmoment = ConcentratedMoment(bdis.MextL)
explode_3 = BooleanToggle(True)
cs_2 = ValueList({"Global": True, "Local": False}, selected="Global")
cforce_2 = ConcentratedForce(bdis.FrG)
cmoment_2 = ConcentratedMoment(bdis.MrL)
f_disp_2 = ForceDisplayConcentratedF(ConcentratedForce=cforce_2, Project=explode_3, CoordinateSystem=cs_2, Scale=_10º_5)
m_disp_2 = MomentDisplayConcentratedM(ConcentratedMoment=cmoment_2, Project=explode_3, CoordinateSystem=cs_2, Scale=_10º_5)
f_disp_3 = ForceDisplayConcentratedF(ConcentratedForce=cforce, Project=explode_3, CoordinateSystem=cs_2, Scale=_10º_5)
m_disp_3 = MomentDisplayConcentratedM(ConcentratedMoment=cmoment, Project=explode_3, CoordinateSystem=True, Scale=_10º_5)

# ----
preview_13 = CustomPreview(Geometry=move_6.Geometry, Shader=ColourSwatch(SwatchColor=RGBA(0, 0, 0, 194)))

# ---- group: Export Internals
cs_3 = ValueList({"Gobal": 0, "Local": 1}, selected="Local")
mframe_4 = Frame(bdis.Frames)
mbeam_3 = Beam(mbeam)
Q_3 = TwistingMomentQ(Beam=mbeam_3, Scale=1, Configuration=2)  # -> Ql, Qr, Qmid, DiagramQ
N_4 = AxialForceN(Beam=mbeam_3, Scale=1, Configuration=2)  # -> Nl, Nr, Nmid, DiagramN
V_3 = BeamV(Beam=mbeam_3, Scale=1)  # -> Vr, Vl, Vmid, D1, D2
M_3 = BeamM(Beam=mbeam_3, Scale=1)  # -> Mr, Ml, D1, D2
value_start_end = ValueStartEnd(lvalue=N_4.Nl, rvalue=N_4.Nr, mframe=mframe_4, cs=cs_3)  # -> v1_start, v2_start, v3_start, v1_mid, v2_mid, v3_mid, v1_end, v2_end, v3_end
value_start_end_2 = ValueStartEnd(lvalue=V_3.Vr, rvalue=V_3.Vl, mframe=mframe_4, cs=cs_3)  # -> v1_start, v2_start, v3_start, v1_mid, v2_mid, v3_mid, v1_end, v2_end, v3_end
value_start_end_3 = ValueStartEnd(lvalue=Q_3.Ql, rvalue=Q_3.Qr, mframe=mframe_4, cs=cs_3)  # -> v1_start, v2_start, v3_start, v1_mid, v2_mid, v3_mid, v1_end, v2_end, v3_end
value_start_end_4 = ValueStartEnd(lvalue=M_3.Mr, rvalue=M_3.Ml, mframe=mframe_4, cs=cs_3)  # -> v1_start, v2_start, v3_start, v1_mid, v2_mid, v3_mid, v1_end, v2_end, v3_end

# ----
mframe_5 = Frame(bdis.Frames)
lng_2 = ListLength(List=mframe_5)
int_3 = Integer(expr("(x-1)/2", lng_2))
int_4 = Integer(expr("x-1", lng_2))
start = Panel("0")
mid_2 = Panel(int_3)
end = Panel(int_4)
item_6 = ListItem(List=mframe_5, Index=start, Wrap=True)
item_7 = ListItem(List=mframe_5, Index=mid_2, Wrap=True)
item_8 = ListItem(List=mframe_5, Index=end, Wrap=True)
mframe_6 = Frame(item_6)
mframe_7 = Frame(item_7)
mframe_8 = Frame(item_8)

# ---- group: discret length
pline_3 = PolyLine(Vertices=bdis.Frames, Closed=False)
num_11 = Number(expr("round(x,8)", pline_3))
num_12 = Number(expr("round(x,8)", crv_3))
subtraction = Subtraction(A=num_12, B=num_11)
panel_15 = Panel(num_12)
panel_16 = Panel(num_11)
panel_17 = Panel(subtraction)

# ----
num_13 = Number(expr("round(x,8)", crv_9))
panel_18 = Panel(num_13)
N_5 = Merge(Data1=value_start_end.v3_start, Data2=value_start_end.v3_mid, Data3=value_start_end.v3_end)
f1_3 = Merge(Data1=value_start_end_2.v1_start, Data2=value_start_end_2.v1_mid, Data3=value_start_end_2.v1_end)
f2 = Merge(Data1=value_start_end_2.v2_start, Data2=value_start_end_2.v2_mid, Data3=value_start_end_2.v2_end)
Q_4 = Merge(Data1=value_start_end_3.v3_start, Data2=value_start_end_3.v3_mid, Data3=value_start_end_3.v3_end)
m1_3 = Merge(Data1=value_start_end_4.v1_start, Data2=value_start_end_4.v1_mid, Data3=value_start_end_4.v1_end)
m2_3 = Merge(Data1=value_start_end_4.v2_start, Data2=value_start_end_4.v2_mid, Data3=value_start_end_4.v2_end)
pdecon_2 = Deconstruct(Point=mframe_7)  # -> XComponent, YComponent, ZComponent
P = Merge(Data1=pdecon_2.XComponent, Data2=pdecon_2.YComponent, Data3=pdecon_2.ZComponent)
panel_19 = Panel(pdecon_2.YComponent)
panel_20 = Panel(pdecon_2.ZComponent)
merge = Merge(Data1=panel_18, Data2=panel_16, Data3=P, Data4=N_5, Data5=f1_3, Data6=f2, Data7=Q_4, Data8=m1_3, Data9=m2_3)
logn = LogN(Number=expr("(x-1)/6", lng_2), Base=2)  # -> expr("x+4", Result)
button = Button()
row_number = Panel(logn)
explode_4 = Explode()  # -> v1_2, v2_2, v3_2

# ==== cluster StartEndFrames
initial_a = ClusterInput()
initial_ouverture = ClusterInput()
initial_twist = ClusterInput()
intial_symetric = ClusterInput()
initial_ouverture_2 = Number(initial_ouverture)
intial_symetric_2 = Integer(intial_symetric)
initial_twist_2 = Number(initial_twist)
initial_a_2 = Number(initial_a)
cluster = Cluster(X=initial_a_2, Z=0)  # -> pt_6, pt_4, pt_5

# ---- group: CONFIG : START / OUVERTURE
angle = Number(initial_ouverture_2)
pt = Point(cluster.pt_6)
pt_2 = Point(cluster.pt_5)
pl = ConstructPlane(Origin=pt, XAxis=expr("{0,0,1}", Vector(78.26149335, 0, 0)), YAxis=expr("{0,-1,0}", Vector(0, 1, 0)))
pl_2 = ConstructPlane(Origin=pt_2, XAxis=expr("{0,0,1}", Vector(78.26149335, 0, 0)), YAxis=expr("{0,-1,0}", Vector(0, 1, 0)))
deplane = DeconstructPlane(Plane=pl)  # -> Origin, XAxis, YAxis, ZAxis
deplane_2 = DeconstructPlane(Plane=pl_2)  # -> Origin, XAxis, YAxis, ZAxis
rot3d = Rotate3D(Geometry=pl_2, Angle=expr("-x", degrees(angle)), Center=deplane_2.Origin, Axis=deplane_2.YAxis)  # -> Geometry, Transform
rot3d_2 = Rotate3D(Geometry=pl, Angle=degrees(angle), Center=deplane.Origin, Axis=deplane.YAxis)  # -> Geometry, Transform

# ---- group: CONFIG : START / TWIST
angle_2 = Number(initial_twist_2)
pln = Plane(rot3d.Geometry)
pln_2 = Plane(rot3d_2.Geometry)
deplane_3 = DeconstructPlane(Plane=pln_2)  # -> Origin, XAxis, YAxis, ZAxis
deplane_4 = DeconstructPlane(Plane=pln)  # -> Origin, XAxis, YAxis, ZAxis
multiplication = Multiplication(A=angle_2, B=intial_symetric_2)
rot3d_3 = Rotate3D(Geometry=pln, Angle=expr("-x", degrees(multiplication)), Center=deplane_4.Origin, Axis=expr("{0,0,1}", Vector(0, 0, 1)))  # -> Geometry, Transform
rot3d_4 = Rotate3D(Geometry=pln_2, Angle=degrees(angle_2), Center=deplane_3.Origin, Axis=expr("{0,0,1}", Vector(0, 0, 1)))  # -> Geometry, Transform

# ----
mframe = Frame(rot3d_3.Geometry)
mframe_2 = Frame(rot3d_4.Geometry)
fe = ClusterOutput(mframe)
fs = ClusterOutput(mframe_2)

# ==== cluster Cluster_2
initial_a = ClusterInput()
initial_a_2 = Number(initial_a)
cluster = Cluster(X=initial_a_2, Z=0)  # -> pt_6, pt_4, pt_5

# ---- group: CONFIG : START
pt = Point(cluster.pt_6)
pt_2 = Point(cluster.pt_5)
pl = ConstructPlane(Origin=pt, XAxis=expr("{0,0,1}", Vector(78.26149335, 0, 0)), YAxis=expr("{0,-1,0}", Vector(0, 1, 0)))
pl_2 = ConstructPlane(Origin=pt_2, XAxis=expr("{0,0,1}", Vector(78.26149335, 0, 0)), YAxis=expr("{0,-1,0}", Vector(0, 1, 0)))

# ----
mframe = Frame(pl_2)
mframe_2 = Frame(pl)
fe = ClusterOutput(mframe)
fs = ClusterOutput(mframe_2)

# ==== cluster Explode
mframe = ClusterInput()
cs = ClusterInput()
vector = ClusterInput()  # "CM/CF"
mframe_2 = Frame(mframe)
cs_2 = Integer(cs)
vector_2 = Vector(vector)  # "CM/CF"
deplane = DeconstructPlane(Plane=mframe_2)  # -> Origin, XAxis, YAxis, ZAxis
# explose un moment ou une force dans le repère global(x,y,z) ou local (1, 2, 3)
dprod = DotProduct(VectorA=vector_2, VectorB=deplane.ZAxis, Unitize=False)
dprod_2 = DotProduct(VectorA=vector_2, VectorB=deplane.XAxis, Unitize=False)
dprod_3 = DotProduct(VectorA=vector_2, VectorB=deplane.YAxis, Unitize=False)
devec = DeconstructVector(Vector=vector_2)  # -> XComponent, YComponent, ZComponent
filter = StreamFilter(Gate=cs_2, Stream0=devec.XComponent, Stream1=dprod_2)
filter_2 = StreamFilter(Gate=cs_2, Stream0=devec.YComponent, Stream1=dprod_3)
filter_3 = StreamFilter(Gate=cs_2, Stream0=devec.ZComponent, Stream1=dprod)
v1 = Number(filter)
v2 = Number(filter_2)
v3 = Number(filter_3)
v1_2 = ClusterOutput(v1)
v2_2 = ClusterOutput(v2)
v3_2 = ClusterOutput(v3)

# ==== cluster ValueStartEnd
mframe = ClusterInput()
cs = ClusterInput()
lvalue = ClusterInput()
rvalue = ClusterInput()
mframe_2 = Frame(mframe)
cs_2 = Integer(cs)
lvalue_2 = Vector(lvalue)
rvalue_2 = Vector(rvalue)
lng = ListLength(List=mframe_2)
mid = Integer(expr("(x-1)/2", lng))
end = Integer(expr("x-1", lng))
start = Integer(0)
item = ListItem(List=rvalue_2, Index=start, Wrap=True)
item_2 = ListItem(List=mframe_2, Index=start, Wrap=True)
item_3 = ListItem(List=lvalue_2, Index=mid, Wrap=True)
item_4 = ListItem(List=mframe_2, Index=mid, Wrap=True)
item_5 = ListItem(List=lvalue_2, Index=end, Wrap=True)
item_6 = ListItem(List=mframe_2, Index=end, Wrap=True)
explode = Explode(vector=item, mframe=item_2, cs=cs_2)  # -> v1_2, v2_2, v3_2
explode_2 = Explode(vector=item_3, mframe=item_4, cs=cs_2)  # -> v1_2, v2_2, v3_2
explode_3 = Explode(vector=item_5, mframe=item_6, cs=cs_2)  # -> v1_2, v2_2, v3_2
v1_start = ClusterOutput(explode.v1_2)
v2_start = ClusterOutput(explode.v2_2)
v3_start = ClusterOutput(explode.v3_2)
v1_mid = ClusterOutput(explode_2.v1_2)
v2_mid = ClusterOutput(explode_2.v2_2)
v3_mid = ClusterOutput(explode_2.v3_2)
v1_end = ClusterOutput(explode_3.v1_2)
v2_end = ClusterOutput(explode_3.v2_2)
v3_end = ClusterOutput(explode_3.v3_2)

# ==== cluster Cluster
X = ClusterInput()
Z = ClusterInput()
pt = ConstructPoint(XCoordinate=expr("x/2", X), YCoordinate=0, ZCoordinate=0)
pt_2 = ConstructPoint(XCoordinate=expr("-x/2", X), YCoordinate=0, ZCoordinate=0)
pt_3 = ConstructPoint(XCoordinate=0, YCoordinate=0, ZCoordinate=Z)
pt_4 = ClusterOutput(pt_3)
pt_5 = ClusterOutput(pt)
pt_6 = ClusterOutput(pt_2)
