# Grasshopper definition WriteSingleBeamProblemToJson.gh (Grasshopper 0.9.76)
# plug-ins: Python Interpreter, TMarsupilami

N = Slider(16, range=0..100)

elongation = Slider(1, range=0.5..1.5)
theta_0 = Slider(0, range=-20..20)

twistmodulo = Slider(-1, range=-2..2)
list = ValueList({"symetric": 1, "antisymetric": -1}, selected="antisymetric")
a = Slider(10, range=5..20)
ouverture = Slider(60, range=0..90)
twist = Slider(30, range=-45..45)

shift_x_y = BooleanToggle(False)
b1 = Slider(0.2, range=0.01..0.5)
b2 = Slider(0.4, range=0..0.5)

f1 = Slider(1, range=1..4)
f1_2 = Slider(1, range=1..4)
t = Slider(0, range=0..1)

# ----
# SECTIONS DEF
sections = PythonScript(shift=shift_x_y, b1=b1, b2=b2, f1=f1, f2=f1_2)  # -> P, R1, R2; inputs shift: Boolean
# ---------- sections: Python ----------
import Rhino.Geometry as rg

if shift:
    lx = b2
    ly = b1
    fx = f2
    fy = f1
    P = rg.Plane.WorldXY
else:
    lx = b1
    ly = b2
    fx = f1
    fy = f2
    P = rg.Plane.WorldXY

P1 = rg.Plane.WorldXY
P1.Origin = P1.Origin - (lx/2)*P1.XAxis - (ly/2)*P1.YAxis
R1 = rg.Rectangle3d(P1, lx, ly)

P2 = rg.Plane.WorldXY
P2.Origin = P2.Origin - (lx/(2*fx))*P2.XAxis - (ly/(2*fy))*P2.YAxis
 
R2 = rg.Rectangle3d(P2, lx/fx, ly/fy)


print lx
print ly
# ---------- end sections ----------
fdis = FrameDisplay(Frame=sections.P, ScaleFactor=2, LineWidth=[0, 3, 3], Color=[RGB(0, 0, 255), RGB(255, 0, 0), RGB(0, 255, 0)])
crv = Curve([sections.R1, sections.R2])

# ----
# INITIAL CONFIG
start_end_frames = StartEndFrames(initial_a=a, initial_ouverture=ouverture, initial_twist=twist, intial_symetric=list)  # -> fs, fe

ne = Integer(N)
geom = DefineBeamGeometrySingle(StartFrame=start_end_frames.fs, EndFrame=start_end_frames.fe, EdgeCount=ne, TwistModulo=twistmodulo)  # -> BeamCenterline, Frames

# ----
# REST CONFIG
len = Length(Curve=geom.BeamCenterline)
multiplication = Multiplication(A=elongation, B=len)
cluster = Cluster_2(initial_a=multiplication)  # -> fs, fe

multiplication_2 = Multiplication(A=ne, B=t)
int = Integer(multiplication_2)
c_script = CSharpScript(
    N=ne,
    n=int,
    R1=sections.R1,
    R2=sections.R2,
    Reference=["C:\USERS\VÉRONIQUE\LIONEL\GITHUB\TMARSUPILAMI2\SRC\TMARSUPILAMI.GH\BIN\TMarsupilami.MathLib.dll", "C:\USERS\VÉRONIQUE\LIONEL\GITHUB\TMARSUPILAMI2\SRC\TMARSUPILAMI.GH\BIN\TMarsupilami.Gh.dll"])  # -> out, bx, by; inputs N: Int32, n: Int32, R1: Rectangle3d, R2: Rectangle3d
# ---------- c_script: C# ----------
    double[] b1, b2;
    b1 = new double[N];
    b2 = new double[N];

    if (n < 1)
    {
      for (int i = 0; i < N; i++)
      {
        b1[i] = R2.Width;
        b2[i] = R2.Height;
      }
    }
    else if (n > N+1)
    {
      for (int i = 0; i < N+1; i++)
      {
        b1[i] = R1.Width;
        b2[i] = R1.Height;
      }
    }
    else
    {
      for (int i = 0; i < n; i++)
      {
        b1[i] = R1.Width;
        b2[i] = R1.Height;
      }
      for (int i = n; i < N; i++)
      {
        b1[i] = R2.Width;
        b2[i] = R2.Height;
      }
    }



    // output
    bx = b1;
    by = b2;
# ---------- end c_script ----------

geom_2 = DefineBeamGeometrySingle(StartFrame=cluster.fs, EndFrame=cluster.fe, EdgeCount=ne, TwistModulo=0)  # -> BeamCenterline, Frames
rz = ZRotateAFrame(FrameS=geom_2.Frames, ZTwistAngleS=theta_0)

crv_2 = Curve(geom_2.BeamCenterline)
mframe = Frame(rz)

crv_3 = Curve(geom.BeamCenterline)
mframe_2 = Frame(geom.Frames)

# ---- group: Display Frames
cull_i = CullIndex(List=mframe, Indices=[0, -1], Wrap=True)
item = ListItem(List=mframe, Index=[0, -1], Wrap=True)
fdis_2 = FrameDisplay(Frame=cull_i, ScaleFactor=1, LineWidth=[2, 1, 1], Color=[RGB(0, 0, 255), RGB(255, 0, 0), RGB(0, 255, 0)])
fdis_3 = FrameDisplay(Frame=item, ScaleFactor=4, LineWidth=3, Color=[RGB(0, 0, 255), RGB(255, 0, 0), RGB(0, 255, 0)])

# ---- group: Display Brep
c_script_2 = CSharpScript(
    centerline=crv_2,
    F=mframe,
    n=int,
    P=sections.P,
    R1=sections.R1,
    R2=sections.R2,
    Reference=["C:\USERS\VÉRONIQUE\LIONEL\GITHUB\TMARSUPILAMI2\SRC\TMARSUPILAMI.GH\BIN\TMarsupilami.MathLib.dll", "C:\USERS\VÉRONIQUE\LIONEL\GITHUB\TMARSUPILAMI2\SRC\TMARSUPILAMI.GH\BIN\TMarsupilami.Gh.dll"])  # -> out, C, S, B; inputs centerline: Curve, F: list, n: Int32, P: Plane, R1: Rectangle3d, R2: Rectangle3d
# ---------- c_script_2: C# ----------
    MFrame[ ] f1, f2;
    Curve c1, c2;
    Curve[] s1, s2;
    Brep b1, b2;

    var sweep = new Rhino.Geometry.SweepOneRail();
    sweep.MiterType = 0;
    sweep.GlobalShapeBlending = false;

    var sweep2 = new Rhino.Geometry.SweepTwoRail();

    if (n < 1)
    {
      f1 = new MFrame[0];
      f2 = new MFrame[F.Count];
      for (int i = 0; i < F.Count; i++)
      {
        f2[i] = (MFrame) F[i];
      }
      c1 = null;
      c2 = centerline;
    }
    else if (n > F.Count)
    {
      f2 = new MFrame[0];
      f1 = new MFrame[F.Count];
      for (int i = 0; i < F.Count; i++)
      {
        f1[i] = (MFrame) F[i];
      }
      c1 = centerline;
      c2 = null;
    }
    else
    {
      f1 = new MFrame[n];
      for (int i = 0; i < f1.Length; i++)
      {
        f1[i] = (MFrame) F[i];
      }
      f2 = new MFrame[F.Count - n + 1];
      for (int i = 0; i < f2.Length; i++)
      {
        f2[i] = (MFrame) F[n - 1 + i];
      }

      // changing point
      double param;
      var point = f1[n - 1].Origin.Cast();
      centerline.ClosestPoint(point, out param);
      var subCurves = centerline.Split(param);
      c1 = subCurves[0];
      c2 = subCurves[1];
    }

    var c = new List<Curve>();
    var s = new List<Curve>();
    var f = new List<MFrame>();
    var b = new List<Brep>();

    // Sweep over C1
    if (c1 != null)
    {
      var pts = new Point3d[f1.Length];
      s1 = new Rhino.Geometry.Curve[f1.Length];
      for (int i = 0; i < f1.Length; i++)
      {
        var xform = Transform.PlaneToPlane(P, f1[i].Cast());
        var polyline = R1.ToPolyline();
        polyline.Transform(xform);
        s1[i] = new Rhino.Geometry.PolylineCurve(polyline);
        pts[i] = polyline[0];
      }
      var rail_ext = Rhino.Geometry.Curve.CreateInterpolatedCurve(pts, 3);
      var rail_int = c1;
      b1 = sweep2.PerformSweep(rail_int, rail_ext, s1)[0];

      var cap_1 = Rhino.Geometry.Brep.CreatePlanarBreps(s1[0])[0];
      var cap_2 = Rhino.Geometry.Brep.CreatePlanarBreps(s1[f1.Length - 1])[0];
      b1 = Brep.JoinBreps(new Brep[3]{cap_1, b1, cap_2}, 1e-9)[0];

      c.Add(c1);
      s.AddRange(s1);
      b.Add(b1);
    }
    if (c2 != null)
    {
      var pts = new Point3d[f2.Length];
      s2 = new Rhino.Geometry.Curve[f2.Length];
      for (int i = 0; i < f2.Length; i++)
      {
        var xform = Transform.PlaneToPlane(P, f2[i].Cast());
        var polyline = R2.ToPolyline();
        polyline.Transform(xform);
        s2[i] = new Rhino.Geometry.PolylineCurve(polyline);
        pts[i] = polyline[0];
      }
      var rail_ext = Rhino.Geometry.Curve.CreateInterpolatedCurve(pts, 3);
      var rail_int = c2;
      b2 = sweep2.PerformSweep(rail_int, rail_ext, s2)[0];

      var cap_1 = Rhino.Geometry.Brep.CreatePlanarBreps(s2[0])[0];
      var cap_2 = Rhino.Geometry.Brep.CreatePlanarBreps(s2[f2.Length - 1])[0];
      b2 = Brep.JoinBreps(new Brep[3]{cap_1, b2, cap_2}, 1e-9)[0];

      c.Add(c2);
      s.AddRange(s2);
      b.Add(b2);
    }

    // output
    C = c;
    S = s;
    B = b;
# ---------- end c_script_2 ----------
crv_4 = Curve(c_script_2.C)
crv_5 = Curve(c_script_2.S)
brep = Brep(c_script_2.B)
preview = CustomPreview(Geometry=brep, Shader=ColourSwatch(SwatchColor=RGB(10, 133, 255)))

# ---- group: Display Frames
cull_i_2 = CullIndex(List=mframe_2, Indices=[0, -1], Wrap=True)
item_2 = ListItem(List=mframe_2, Index=[0, -1], Wrap=True)
fdis_4 = FrameDisplay(Frame=cull_i_2, ScaleFactor=1, LineWidth=[2, 1, 1], Color=[RGB(0, 0, 255), RGB(255, 0, 0), RGB(0, 255, 0)])
fdis_5 = FrameDisplay(Frame=item_2, ScaleFactor=4, LineWidth=3, Color=[RGB(0, 0, 255), RGB(255, 0, 0), RGB(0, 255, 0)])

# ---- group: Display Brep
c_script_3 = CSharpScript(
    centerline=crv_3,
    F=mframe_2,
    n=int,
    P=sections.P,
    R1=sections.R1,
    R2=sections.R2,
    Reference=["C:\Users\Véronique\Lionel\Github\TMarsupilami2\src\TMarsupilami.Gh\bin\TMarsupilami.MathLib.dll", "C:\Users\Véronique\Lionel\Github\TMarsupilami2\src\TMarsupilami.Gh\bin\TMarsupilami.Gh.dll"])  # -> out, C, S, B; inputs centerline: Curve, F: list, n: Int32, P: Plane, R1: Rectangle3d, R2: Rectangle3d; same code as c_script_2
crv_6 = Curve(c_script_3.C)
crv_7 = Curve(c_script_3.S)
brep_2 = Brep(c_script_3.B)
preview_2 = CustomPreview(Geometry=brep_2, Shader=ColourSwatch(SwatchColor=RGB(255, 255, 255)))

# ----
fx = Panel("0")
fy = Panel("1e5")
fz = Panel("1e6")
vec = VectorXYZ(XComponent=fx, YComponent=fy, ZComponent=fz)  # -> Vector, Length

m1 = Panel("0")
m2 = Panel("0")
m3 = Panel("-1e6")
vec_2 = VectorXYZ(XComponent=m1, YComponent=m2, ZComponent=m3)  # -> Vector, Length

fx_2 = Panel("0")
fy_2 = Panel("0")
fz_2 = Panel("1e5")
vec_3 = VectorXYZ(XComponent=fx_2, YComponent=fy_2, ZComponent=fz_2)  # -> Vector, Length

m1_2 = Panel("0")
m2_2 = Panel("0")
m3_2 = Panel("1e5")
vec_4 = VectorXYZ(XComponent=m1_2, YComponent=m2_2, ZComponent=m3_2)  # -> Vector, Length

list_2 = ValueList({"FREE": 0, "PIN": 1, "CLAMPED": 2}, selected="CLAMPED")
list_3 = ValueList({"FREE": 0, "PIN": 1, "CLAMPED": 2}, selected="PIN")

# ---- group: Beam A
sections_0 = Plane(rz)
sections_i = Plane(mframe_2)
section_b1 = Number(c_script.bx)
section_b2 = Number(c_script.by)

# ----
scale_factor = Slider(-3.7, range=-10..10)
write_sbp = WriteSingleBeamProblem(
    FilePath="C:\Users\Véronique\Lionel\Github\TMP\input.json",
    RestConfiguration=sections_0,
    ActualConfiguration=sections_i,
    RectangularSectionWidth=b1,
    RectangularSectionHeight=b2,
    BoundaryConditionAtStart=list_2,
    BoundaryConditionAtEnd=list_3)
_10º = PowerOf10(Value=scale_factor)
reset = Button()
refine = Button()
max_iter = Panel("5000")
read_sbp = ReadSingleBeamProblem(FilePath="C:\Users\Véronique\Lionel\Github\TMP\test_res.json")
bench_1d = Bench1B(
    RestPosition=sections_0,
    InitialPosition=sections_i,
    SectionB1=section_b1,
    SectionB2=section_b2,
    BoundaryConditionAtStart=list_2,
    BoundaryConditionAtEnd=list_3,
    ConcentratedForce=vec.Vector,
    ConcentratedMoment=vec_2.Vector,
    DistributedForce=vec_3.Vector,
    DistributedMoment=vec_4.Vector,
    Iteration_max=max_iter,
    Reset=reset,
    Refine=refine)
config = ValueList({"Rest": 0, "Initial": 1, "Actual": 2}, selected="Rest")
scale_factor_2 = Slider(0.4, range=-10..10)
mbeam = Beam(read_sbp)
mbeam_2 = Beam(mbeam)

swatch = ColourSwatch(SwatchColor=RGB(114, 95, 222))
energy = BeamEnergy(Beam=mbeam_2, Scale=_10º, Configuration=config)  # -> AxialEnergy, BendingEnergy, TwistingEnergy, DiagramEa, DiagramEb, DiagramEt
preview_3 = CustomPreview(Geometry=energy.DiagramEb, Shader=swatch)
preview_4 = CustomPreview(Geometry=energy.DiagramEt, Shader=swatch)

config_2 = ValueList({"Rest": 0, "Initial": 1, "Actual": 2}, selected="Rest")
_10º_2 = PowerOf10(Value=scale_factor_2)

panel = Panel(_10º_2)
ε = BeamΕ(Beam=mbeam_2, Scale=panel, RestActual=config)  # -> Εr, Εl, Εmid, DiagramΕ
preview_5 = CustomPreview(Geometry=ε.DiagramΕ, Shader=ColourSwatch(SwatchColor=RGB(255, 255, 255)))

panel_2 = Panel(_10º_2)
τ = BeamΤ(Beam=mbeam_2, Scale=panel_2, RestActual=config)  # -> Τr, Τl, Τmid, DiagramΤ
preview_6 = CustomPreview(Geometry=τ.DiagramΤ, Shader=ColourSwatch(SwatchColor=RGB(237, 230, 28)))

panel_3 = Panel(_10º_2)
κ = BeamΚ(Beam=mbeam_2, Scale=panel_3, RestActual=config)  # -> Κbl, Κbr, Κbmid, D1, D2
preview_7 = CustomPreview(Geometry=[κ.D1, κ.D2], Shader=ColourSwatch(SwatchColor=RGB(209, 25, 25)))

geometry = BeamGeometry(Beam=mbeam, Configuration=config_2)
bdis = BeamInternals(Beam=mbeam)  # -> Frames, FramesMid, FextG, MextL, FextG_2, MextL_2, FrG, MrL
fdis_6 = FrameDisplay(Frame=geometry, ScaleFactor=4, LineWidth=[2, 1, 1], Color=[RGB(0, 0, 255), RGB(255, 0, 0), RGB(0, 255, 0)])
item_3 = ListItem(List=bdis.Frames, Index=Slider(16, range=0..100), Wrap=True)
scale_factor_3 = Slider(-5.9, range=-10..10)
explode = Slider(5, range=0..10)
pt = Point(item_3)
Y = UnitY(Factor=explode)
_10º_3 = PowerOf10(Value=scale_factor_3)

panel_4 = Panel(_10º_3)
V = BeamV(Beam=mbeam_2, Scale=panel_4, RestActual=config)  # -> Vr, Vl, Vmid, D1, D2
move = Move(Geometry=[V.D1, V.D2], Motion=expr("2*x", Y))  # -> Geometry, Transform
preview_8 = CustomPreview(Geometry=move.Geometry, Shader=ColourSwatch(SwatchColor=RGB(55, 255, 0)))

panel_5 = Panel(_10º_3)
N_2 = BeamDiagram(Beam=mbeam_2, Scale=panel_5, RestActual=config)  # -> Nl, Nr, Nmid, D
move_2 = Move(Geometry=N_2.D, Motion=Y)  # -> Geometry, Transform
preview_9 = CustomPreview(Geometry=move_2.Geometry, Shader=ColourSwatch(SwatchColor=RGB(255, 255, 255)))

panel_6 = Panel(_10º_3)
Q = BeamQ(Beam=mbeam_2, Scale=panel_6, RestActual=config)  # -> Qr, Ql, Qmid, D
move_3 = Move(Geometry=Q.D, Motion=expr("4*x", Y))  # -> Geometry, Transform
preview_10 = CustomPreview(Geometry=move_3.Geometry, Shader=ColourSwatch(SwatchColor=RGB(237, 230, 28)))

panel_7 = Panel(_10º_3)
M = BeamM(Beam=mbeam_2, Scale=panel_7, RestActual=config)  # -> Mr, Ml, D1, D2
move_4 = Move(Geometry=[M.D1, M.D2], Motion=expr("3*x", Y))  # -> Geometry, Transform
preview_11 = CustomPreview(Geometry=move_4.Geometry, Shader=ColourSwatch(SwatchColor=RGB(255, 0, 0)))

mframe_3 = Frame(bdis.Frames)
intcrv = Interpolate(Vertices=mframe_3, Degree=3, Periodic=False, KnotStyle=1)  # -> Curve, Length, Domain
crv_8 = Curve(intcrv.Curve)

num = Number(M.Ml)

num_2 = Number([N_2.Nr, N_2.Nl, N_2.Nmid])
bnd = Bounds(Numbers=num_2)
dedomain = DeconstructDomain(Domain=bnd)  # -> expr("round(x)", Start), expr("round(x)", End)
min = Panel(dedomain.Start)
max = Panel(dedomain.End)

num_3 = Number(V.Vmid)

num_4 = Number([V.Vr, V.Vl, V.Vmid])
bnd_2 = Bounds(Numbers=num_4)
dedomain_2 = DeconstructDomain(Domain=bnd_2)  # -> expr("round(x)", Start), expr("round(x)", End)
min_2 = Panel(dedomain_2.Start)
max_2 = Panel(dedomain_2.End)

num_5 = Number([M.Mr, M.Ml])
bnd_3 = Bounds(Numbers=num_5)
dedomain_3 = DeconstructDomain(Domain=bnd_3)  # -> expr("round(x)", Start), expr("round(x)", End)
min_3 = Panel(dedomain_3.Start)
max_3 = Panel(dedomain_3.End)

num_6 = Number([Q.Qr, Q.Ql, Q.Qmid])
bnd_4 = Bounds(Numbers=num_6)
dedomain_4 = DeconstructDomain(Domain=bnd_4)  # -> expr("round(x)", Start), expr("round(x)", End)
min_4 = Panel(dedomain_4.Start)
max_4 = Panel(dedomain_4.End)

panel_8 = Panel(num)
scale_factor_4 = Slider(-6.1, range=-10..10)

# ---- group: Display Frames
cull_i_3 = CullIndex(List=mframe_3, Indices=[0, -1], Wrap=True)
item_4 = ListItem(List=mframe_3, Index=[0, -1], Wrap=True)
fdis_7 = FrameDisplay(Frame=cull_i_3, ScaleFactor=1, LineWidth=[2, 1, 1], Color=[RGB(0, 0, 255), RGB(255, 0, 0), RGB(0, 255, 0)])
fdis_8 = FrameDisplay(Frame=item_4, ScaleFactor=4, LineWidth=3, Color=[RGB(0, 0, 255), RGB(255, 0, 0), RGB(0, 255, 0)])

# ---- group: Display Brep
c_script_4 = CSharpScript(
    centerline=crv_8,
    F=mframe_3,
    P=sections.P,
    R1=sections.R1,
    R2=sections.R2,
    Reference=["C:\USERS\VÉRONIQUE\LIONEL\GITHUB\TMARSUPILAMI2\SRC\TMARSUPILAMI.GH\BIN\TMarsupilami.MathLib.dll", "C:\USERS\VÉRONIQUE\LIONEL\GITHUB\TMARSUPILAMI2\SRC\TMARSUPILAMI.GH\BIN\TMarsupilami.Gh.dll"])  # -> out, C, S, B; inputs centerline: Curve, F: list, n: Int32, P: Plane, R1: Rectangle3d, R2: Rectangle3d; same code as c_script_2
crv_9 = Curve(c_script_4.C)
crv_10 = Curve(c_script_4.S)
brep_3 = Brep(c_script_4.B)
preview_12 = CustomPreview(Geometry=brep_3, Shader=ColourSwatch(SwatchColor=RGBA(255, 247, 10, 84)))

# ---- group: DISPLAY fext mext
dforce = DistributedForce(bdis.FextG_2)
dmoment = DistributedMoment(bdis.MextL_2)
explode_2 = BooleanToggle(False)
cs = ValueList({"Global": True, "Local": False}, selected="Global")
_10º_4 = PowerOf10(Value=scale_factor_4)
f_disp = ForceDisplayDistributedF(DistributedForce=dforce, Project=explode_2, CoordinateSystem=cs, Scale=_10º_4)
m_disp = MomentDisplayDistributedM(DistributedMoment=dmoment, Project=explode_2, CoordinateSystem=cs, Scale=_10º_4)

# ----
_10º_5 = PowerOf10(Value=scale_factor_4)

# ---- group: DISPLAY Fext Mext
cforce = ConcentratedForce(bdis.FextG)
cmoment = ConcentratedMoment(bdis.MextL)
explode_3 = BooleanToggle(True)
cs_2 = ValueList({"Global": True, "Local": False}, selected="Global")
cforce_2 = ConcentratedForce(bdis.FrG)
cmoment_2 = ConcentratedMoment(bdis.MrL)
f_disp_2 = ForceDisplayConcentratedF(ConcentratedForce=cforce_2, Project=explode_3, CoordinateSystem=cs_2, Scale=_10º_5)
m_disp_2 = MomentDisplayConcentratedM(ConcentratedMoment=cmoment_2, Project=explode_3, CoordinateSystem=cs_2, Scale=_10º_5)
f_disp_3 = ForceDisplayConcentratedF(ConcentratedForce=cforce, Project=explode_3, CoordinateSystem=cs_2, Scale=_10º_5)
m_disp_3 = MomentDisplayConcentratedM(ConcentratedMoment=cmoment, Project=explode_3, CoordinateSystem=True, Scale=_10º_5)

# ==== cluster StartEndFrames
initial_a = ClusterInput()
initial_ouverture = ClusterInput()
initial_twist = ClusterInput()
intial_symetric = ClusterInput()
initial_ouverture_2 = Number(initial_ouverture)
intial_symetric_2 = Integer(intial_symetric)
initial_twist_2 = Number(initial_twist)
initial_a_2 = Number(initial_a)
cluster = Cluster(X=initial_a_2, Z=0)  # -> pt_6, pt_4, pt_5

# ---- group: CONFIG : START / OUVERTURE
angle = Number(initial_ouverture_2)
pt = Point(cluster.pt_6)
pt_2 = Point(cluster.pt_5)
pl = ConstructPlane(Origin=pt, XAxis=expr("{0,0,1}", Vector(78.26149335, 0, 0)), YAxis=expr("{0,-1,0}", Vector(0, 1, 0)))
pl_2 = ConstructPlane(Origin=pt_2, XAxis=expr("{0,0,1}", Vector(78.26149335, 0, 0)), YAxis=expr("{0,-1,0}", Vector(0, 1, 0)))
deplane = DeconstructPlane(Plane=pl)  # -> Origin, XAxis, YAxis, ZAxis
deplane_2 = DeconstructPlane(Plane=pl_2)  # -> Origin, XAxis, YAxis, ZAxis
rot3d = Rotate3D(Geometry=pl_2, Angle=expr("-x", degrees(angle)), Center=deplane_2.Origin, Axis=deplane_2.YAxis)  # -> Geometry, Transform
rot3d_2 = Rotate3D(Geometry=pl, Angle=degrees(angle), Center=deplane.Origin, Axis=deplane.YAxis)  # -> Geometry, Transform

# ---- group: CONFIG : START / TWIST
angle_2 = Number(initial_twist_2)
pln = Plane(rot3d.Geometry)
pln_2 = Plane(rot3d_2.Geometry)
deplane_3 = DeconstructPlane(Plane=pln_2)  # -> Origin, XAxis, YAxis, ZAxis
deplane_4 = DeconstructPlane(Plane=pln)  # -> Origin, XAxis, YAxis, ZAxis
multiplication = Multiplication(A=angle_2, B=intial_symetric_2)
rot3d_3 = Rotate3D(Geometry=pln, Angle=expr("-x", degrees(multiplication)), Center=deplane_4.Origin, Axis=expr("{0,0,1}", Vector(0, 0, 1)))  # -> Geometry, Transform
rot3d_4 = Rotate3D(Geometry=pln_2, Angle=degrees(angle_2), Center=deplane_3.Origin, Axis=expr("{0,0,1}", Vector(0, 0, 1)))  # -> Geometry, Transform

# ----
mframe = Frame(rot3d_3.Geometry)
mframe_2 = Frame(rot3d_4.Geometry)
fe = ClusterOutput(mframe)
fs = ClusterOutput(mframe_2)

# ==== cluster Cluster_2
initial_a = ClusterInput()
initial_a_2 = Number(initial_a)
cluster = Cluster(X=initial_a_2, Z=0)  # -> pt_6, pt_4, pt_5

# ---- group: CONFIG : START
pt = Point(cluster.pt_6)
pt_2 = Point(cluster.pt_5)
pl = ConstructPlane(Origin=pt, XAxis=expr("{0,0,1}", Vector(78.26149335, 0, 0)), YAxis=expr("{0,-1,0}", Vector(0, 1, 0)))
pl_2 = ConstructPlane(Origin=pt_2, XAxis=expr("{0,0,1}", Vector(78.26149335, 0, 0)), YAxis=expr("{0,-1,0}", Vector(0, 1, 0)))

# ----
mframe = Frame(pl_2)
mframe_2 = Frame(pl)
fe = ClusterOutput(mframe)
fs = ClusterOutput(mframe_2)

# ==== cluster Cluster
X = ClusterInput()
Z = ClusterInput()
pt = ConstructPoint(XCoordinate=expr("x/2", X), YCoordinate=0, ZCoordinate=0)
pt_2 = ConstructPoint(XCoordinate=expr("-x/2", X), YCoordinate=0, ZCoordinate=0)
pt_3 = ConstructPoint(XCoordinate=0, YCoordinate=0, ZCoordinate=Z)
pt_4 = ClusterOutput(pt_3)
pt_5 = ClusterOutput(pt)
pt_6 = ClusterOutput(pt_2)
