# Grasshopper definition section inertia.gh (Grasshopper 0.9.76)
# plug-ins: TMarsupilami

pt = Point(<point referenced from the Rhino model>)
pt_2 = ConstructPoint(XCoordinate=0, YCoordinate=0, ZCoordinate=0)
Z = UnitZ(Factor=1)
line = LineSDL(Start=pt_2, Direction=Z, Length=1)
panel = Panel(pt)
pt_3 = Point(pt)
crv = Curve(<curve referenced from the Rhino model>)
boundary = BoundarySurfaces(Edges=crv)
srf = Surface(boundary)
c_script = CSharpScript(srf=srf, Reference="C:\Users\Admin\AppData\Roaming\Grasshopper\Libraries\alglibnet2.dll")  # -> out, P, S, I1, I2, I3, I; inputs srf: Surface
# ---------- c_script: C# ----------
    double tolerance = 1e-4;
    
    // Make sure the surface is planar
    Plane surfacePlane;
    if(srf.TryGetPlane(out surfacePlane, tolerance))
    {

      // Position the surface plane at the centroid
      var amp = AreaMassProperties.Compute(srf);
      var centroid = amp.Centroid;
      var a = centroid.X;
      var b = centroid.Y;
      var c = centroid.Z;
      surfacePlane.Origin = centroid;

      // Get section area
      var A = amp.Area;

      // Compute the inertia tensor in the world coordinate system ROxyz = {O,ex,ey,ez}
      var IO_xx = amp.WorldCoordinatesMomentsOfInertia.X;
      var IO_yy = amp.WorldCoordinatesMomentsOfInertia.Y;
      var IO_zz = amp.WorldCoordinatesMomentsOfInertia.Z;
      var IO_xy = -amp.WorldCoordinatesProductMoments.X;
      var IO_xz = -amp.WorldCoordinatesProductMoments.Z;
      var IO_yz = -amp.WorldCoordinatesProductMoments.Y;

      // Compute the inertia tensor in the world coordinate system RGxyz = {G,ex,ey,ez} translated to the centroid (G)
      // this requires Huygens theorem
      var IG_xx = IO_xx - A * (b * b + c * c);
      var IG_yy = IO_yy - A * (a * a + c * c);
      var IG_zz = IO_zz - A * (a * a + b * b);
      var IG_xy = IO_xy + A * a * b;
      var IG_xz = IO_xz + A * a * c;
      var IG_yz = IO_yz + A * b * c;

      var IGxyz = new Matrix(3, 3);
      IGxyz[0, 0] = IG_xx;    IGxyz[0, 1] = IG_xy;    IGxyz[0, 2] = IG_xz;
      IGxyz[1, 0] = IG_xy;    IGxyz[1, 1] = IG_yy;    IGxyz[1, 2] = IG_yz;
      IGxyz[2, 0] = IG_xz;    IGxyz[2, 1] = IG_yz;    IGxyz[2, 2] = IG_zz;

      // #####################
      // first change of basis
      // #####################

      // We express the inertia tensor in the surfacePlane coordinate system RGijk = {G, ei, ej, ek}.
      // We know that ek is normal to the surface and that ei and ej lie on the surface.
      // Thus the tensor components : IG_ik = IG_jk = 0 and IG_kk will be the polar inertia and third eigen value

      // We call P1 the transformation matrix from RGijk to RGxyz, that is the columns of P1 are {ei,ej,ek}.
      // We call TP1 the transpose of P1.
      var ei = surfacePlane.XAxis;
      var ej = surfacePlane.YAxis;
      var ek = surfacePlane.ZAxis;
      var P1 = new Matrix(3, 3);
      P1[0, 0] = ei.X;       P1[0, 1] = ej.X;       P1[0, 2] = ek.X;
      P1[1, 0] = ei.Y;       P1[1, 1] = ej.Y;       P1[1, 2] = ek.Y;
      P1[2, 0] = ei.Z;       P1[2, 1] = ej.Z;       P1[2, 2] = ek.Z;

      // The Inertia tensor in RGijk is now : IGijk = TP1 x IG_RGxyz x P1
      var TP1 = P1.Duplicate(); TP1.Transpose();
      var IGijk = TP1 * IGxyz * P1;
      var IG_ii = IGijk[0, 0];
      var IG_jj = IGijk[1, 1];
      var IG_kk = IGijk[2, 2];
      var IG_ij = IGijk[0, 1];

      // #######################
      // second change of basis
      // #######################

      // based on : http://scipp.ucsc.edu/~haber/ph116A/diag2x2_11.pdf

      // We know the third eigen value and corresponding eigen vector for IGxyz :
      var e3 = ek;
      var IG_33 = IG_kk;

      // We have now a simpler 2x2 diagonalisation problem to solve, that is a rotation in the plane perpendicular to e3 = ek
      // The remaining eigen values satisfy the following equation : l^2 - (IG_ii + IG_jj)l + (IG_ii*IG_jj) - IG_ij^2 = 0
      var D = Math.Sqrt((IG_ii - IG_jj) * (IG_ii - IG_jj) + 4 * IG_ij * IG_ij);
      var IG_11 = 0.5 * ((IG_ii + IG_jj) + D); // strong axis
      var IG_22 = 0.5 * ((IG_ii + IG_jj) - D); // weak axis (IG_22 < IG_11)

      // The eigen vector e1 associated with eigen value IG_11 is given by :
      var e1 = 2 * IG_ij * ei + (IG_jj - IG_ii + D) * ej;
      e1.Unitize();

      // The eigen vector e2 associated with eigen value IG_22 is given by :
      var e2 = 2 * IG_ij * ei + (IG_jj - IG_ii - D) * ej;
      e2.Unitize();

      // Thus, the sectioPlane si given by {G, e1, e2, e3 = e1 x e2}
      var sectionPlane = new Plane(centroid, e1, e2);

      // We call P2 the transformation matrix from RG123 to RGxyz, that is the columns of P2 are {e1,e2,e3}.
      // We call TP2 the transpose of P2.
      var P2 = new Matrix(3, 3);
      P2[0, 0] = e1.X; P2[0, 1] = e2.X; P2[0, 2] = e3.X;
      P2[1, 0] = e1.Y; P2[1, 1] = e2.Y; P2[1, 2] = e3.Y;
      P2[2, 0] = e1.Z; P2[2, 1] = e2.Z; P2[2, 2] = e3.Z;
      var TP2 = P2.Duplicate(); TP2.Transpose();
      var IG123 = TP2 * IGxyz * P2;

      // the previous computation is not necessary has we already know that IG123 = diag(IG_11, IG_22, IG_33)
      // but it's a way to check the results
      //var IG123 = new Matrix(3, 3);
      //IG123[0, 0] = IG_11;
      //IG123[1, 1] = IG_22;
      //IG123[2, 2] = IG_33;

      P = sectionPlane;
      S = A;
      I1 = IG_11;
      I2 = IG_22;
      I3 = IG_33;
      I = IG123;
    }
# ---------- end c_script ----------
pdecon = Deconstruct(Point=pt)  # -> XComponent, YComponent, ZComponent
number_slider = Slider(57, range=0..100)
rotax = RotateAxis(Geometry=boundary, Angle=degrees(number_slider), Axis=line)  # -> Geometry, Transform
rotax_2 = RotateAxis(Geometry=pt, Angle=degrees(number_slider), Axis=line)  # -> Geometry, Transform
c_script_2 = CSharpScript(S=srf, pt=pt_3, Reference="C:\Users\Admin\AppData\Roaming\Grasshopper\Libraries\alglibnet2.dll")  # -> out, G, B, mat, Ixyz_O, Ixyz_G, I123_G; inputs S: Surface, pt: Point3d
# ---------- c_script_2: C# ----------
    var mp = AreaMassProperties.Compute(S);

    var G = mp.Centroid;
    var A = mp.Area;

    var Ixx = mp.WorldCoordinatesMomentsOfInertia.X;
    var Iyy = mp.WorldCoordinatesMomentsOfInertia.Y;
    var Izz = mp.WorldCoordinatesMomentsOfInertia.Z;
    var Ixy = mp.WorldCoordinatesProductMoments.X;
    var Ixz = mp.WorldCoordinatesProductMoments.Z;
    var Iyz = mp.WorldCoordinatesProductMoments.Y;

    // matrix of inertia in the world basis {x,y,z} at point O = (0,0,0):
    var Ixyz_O = new Matrix(3, 3);
    Ixyz_O[0, 0] = +Ixx;    Ixyz_O[0, 1] = -Ixy;    Ixyz_O[0, 2] = -Ixz;
    Ixyz_O[1, 0] = -Ixy;    Ixyz_O[1, 1] = +Iyy;    Ixyz_O[1, 2] = -Iyz;
    Ixyz_O[2, 0] = -Ixz;    Ixyz_O[2, 1] = -Iyz;    Ixyz_O[2, 2] = +Izz;

    // translation matrix (Huygens Theorem) from O to G
    var Ixyz_OG = new Matrix(3, 3); var a = G.X; var b = G.Y; var c = G.Z;
    Ixyz_OG[0, 0] = b * b + c * c;  Ixyz_OG[0, 1] = -a * b;         Ixyz_OG[0, 2] = -a * c;
    Ixyz_OG[1, 0] = -a * b;         Ixyz_OG[1, 1] = a * a + c * c;  Ixyz_OG[1, 2] = -b * c;
    Ixyz_OG[2, 0] = -a * c;         Ixyz_OG[2, 1] = -b * c;         Ixyz_OG[2, 2] = a * a + b * b;
    Ixyz_OG.Scale(-A);

    // matrix of inertia in the world basis {x,y,z} at point G = (a,b,c):
    var Ixyz_G = Ixyz_O + Ixyz_OG;

    // local basis {e1,e2,e3} of the section where I123 is diagonal
    // assumes that TryGetPlane gives a plane oriented along the principal axes of inertia
    // this seems the case
    Plane B;
    S.TryGetPlane(out B);

    // eigen values expressed in the basis {x,y,z}
    var e1 = new Matrix(3, 1); var e2 = new Matrix(3, 1); var e3 = new Matrix(3, 1);
    e1[0, 0] = B.XAxis.X;   e2[0, 0] = B.YAxis.X;     e3[0, 0] = B.ZAxis.X;
    e1[1, 0] = B.XAxis.Y;   e2[1, 0] = B.YAxis.Y;     e3[1, 0] = B.ZAxis.Y;
    e1[2, 0] = B.XAxis.Z;   e2[2, 0] = B.YAxis.Z;     e3[2, 0] = B.ZAxis.Z;

    // changing basis form {e1,e2,e3} to {x,y,z} with the matrix P
    // remark that P is symetric (because I is symetric)and thus P.P^T = P^T.P = Id and P^T = P^-1
    var P = new Matrix(3, 3);
    P[0, 0] = e1[0, 0];     P[0, 1] = e2[0, 0];       P[0, 2] = e3[0, 0];
    P[1, 0] = e1[1, 0];     P[1, 1] = e2[1, 0];       P[1, 2] = e3[1, 0];
    P[2, 0] = e1[2, 0];     P[2, 1] = e2[2, 0];       P[2, 2] = e3[2, 0];

    // eigen values (Ixyz_G.ek = Ik.ek)
    var te1 = e1.Duplicate(); te1.Transpose();
    var I11 = (te1 * Ixyz_G * e1)[0, 0];
    var te2 = e2.Duplicate(); te2.Transpose();
    var I22 = (te2 * Ixyz_G * e2)[0, 0];
    var te3 = e3.Duplicate(); te3.Transpose();
    var I33 = (te3 * Ixyz_G * e3)[0, 0];

    // verification (change from 0 to G)
    Print("d11 = " + (mp.CentroidCoordinatesMomentsOfInertia.X - Ixyz_G[0, 0]));
    Print("d22 = " + (mp.CentroidCoordinatesMomentsOfInertia.Y - Ixyz_G[1, 1]));
    Print("d33 = " + (mp.CentroidCoordinatesMomentsOfInertia.Z - Ixyz_G[2, 2]));

    // verification (P.P^T = Id)
    var TP = P.Duplicate();
    TP.Transpose();
    mat = P * TP;

    // verification (I)
    Print("I11 = " + I11);
    Print("I22 = " + I22);
    Print("I33 = " + I33);

    var D = TP * Ixyz_G * P;

    // position vector of pt in coordinate system {G,x,y,z}
    var x = new Matrix(3, 1);
    x[0, 0] = pt.X - G.X;
    x[1, 0] = pt.Y - G.Y;
    x[2, 0] = pt.Z - G.Z;

    // position vector of pt in coordinate system {G,e1,e2,e3}
    var X = TP * x;

    Print("---------------");
    Print("X = " + x[0, 0]);
    Print("Y = " + x[1, 0]);
    Print("Z = " + x[2, 0]);
    Print("---------------");
    Print("X = " + X[0, 0]);
    Print("Y = " + X[1, 0]);
    Print("Z = " + X[2, 0]);
    Print("---------------");
    Print("e1.e1 = " + (te1 * e1)[0, 0]);
    Print("e2.e2 = " + (te2 * e2)[0, 0]);
    Print("e3.e3 = " + (te3 * e3)[0, 0]);
    Print("e1.e2 = " + (te1 * e2)[0, 0]);
    Print("e1.e3 = " + (te1 * e3)[0, 0]);
    Print("e2.e3 = " + (te2 * e3)[0, 0]);


    var ex = new Matrix(3, 1); var ey = new Matrix(3, 1); var ez = new Matrix(3, 1);
    ex[0, 0] = 1;   ey[0, 0] = 0;     ez[0, 0] = 0;
    ex[1, 0] = 0;   ey[1, 0] = 1;     ez[1, 0] = 0;
    ex[2, 0] = 0;   ey[2, 0] = 0;     ez[2, 0] = 1;

    var tex = ex.Duplicate(); tex.Transpose();
    var tey = ey.Duplicate(); tey.Transpose();
    var tez = ez.Duplicate(); tez.Transpose();



    Print("---------------");
    Print("Ixx = " + (tex * Ixyz_G * ex)[0, 0]);
    Print("Iyy = " + (tey * Ixyz_G * ey)[0, 0]);
    Print("Iyy = " + (tez * Ixyz_G * ez)[0, 0]);
    Print("Ixy = " + (tex * Ixyz_G * ey)[0, 0]);
    Print("Ixz = " + (tex * Ixyz_G * ez)[0, 0]);
    Print("Iyz = " + (tey * Ixyz_G * ez)[0, 0]);
    Print("---------------");
    Print("I11 = " + (te1 * Ixyz_G * e1)[0, 0]);
    Print("I22 = " + (te2 * Ixyz_G * e2)[0, 0]);
    Print("I33 = " + (te3 * Ixyz_G * e3)[0, 0]);
    Print("I12 = " + (te1 * Ixyz_G * e2)[0, 0]);
    Print("I13 = " + (te1 * Ixyz_G * e3)[0, 0]);
    Print("I23 = " + (te2 * Ixyz_G * e3)[0, 0]);


    _B = B;
    _G = G;
    _Ixyz_O = Ixyz_O;
    _Ixyz_G = Ixyz_G;
    _I123_G = D;
    //G = _G;
    //A = _A;
    //I1 = _I11;
    //I2 = _I22;
    //I3 = _I33;
    //Ix = _Ix;
    //Iy = _Iy;
    //Iz = _Iz;


    // matrice d'inertie dans la base x,y,z au point 0 :

    //Ixyz[0, 0] = _I11;    Ixyz[0, 1] = _I12;    Ixyz[0, 2] = _I13;
    //Ixyz[1, 0] = _I21;    Ixyz[1, 1] = _I22;    Ixyz[1, 2] = _I12;
    //Ixyz[2, 0] = _I31;    Ixyz[2, 1] = _I32;    Ixyz[2, 2] = _I33;
# ---------- end c_script_2 ----------
matrix = DisplayMatrix(c_script.I, Digits=0)
panel_2 = Panel(c_script_2.out)
amoments = AreaMoments(Geometry=boundary)  # -> Area, Centroid, Inertia, InertiaError, Secondary, SecondaryError, Gyration
matrix_2 = DisplayMatrix(c_script_2.Ixyz_O, Digits=0)

iz = Panel(c_script_2.Ixyz_O)

matrix_3 = DisplayMatrix(c_script_2.mat)
sprop = SectionProperties(TheSection=srf)  # -> F, A, IG_g, I123
xy = XYPlane(Origin=Point(0, 0, 0))
orient = Orient(Geometry=srf, Source=sprop.F, Target=xy)  # -> Geometry, Transform
matrix_4 = DisplayMatrix(sprop.I123, Digits=0)
amoments_2 = AreaMoments(Geometry=orient.Geometry)  # -> Area, Centroid, Inertia, InertiaError, Secondary, SecondaryError, Gyration
sprop_2 = SectionProperties(TheSection=orient.Geometry)  # -> F, A, IG_g, I123
matrix_5 = DisplayMatrix(sprop.IG_g, Digits=0)
matrix_6 = DisplayMatrix(c_script_2.I123_G, Digits=0)
matrix_7 = DisplayMatrix(sprop_2.IG_g, Digits=0)
